# Grasshopper definition Duchame003.gh (Grasshopper 1.0.7)
# plug-ins: Bifocals

optional_seed_for_jitter_node = Slider(27, range=0..100)
# Parameters to Play with!
uv_point_count = Slider(100, range=0..100)
height_map = Slider(2, range=0..2)

# ----
# Optional Gene Pool
# for Dispatch Pattern
gene_pool = GenePool(
    Decimals=0,
    Maximum=1,
    Minimum=0,
    Value=[0.7781919342, 0.5005636865, 0.6644938833, 0.4016935711, 0.9494723957, 0.8208420462, 0.4284389147, 0.1336825402, 0.07872878531, 0.2197422638, 0.6104933292, 0.1224618853, 0.5840545528, 0.8308359435, 0.7583080031, 0.9942445485, 0.3297216638, 0.04509550289, 0.8307831552, 0.05786600106, 0.3521249012, 0.3204974194, 0.3824567559, 0.764870542, 0.1852175031, 0.1811330482, 0.750880869, 0.5847950674, 0.5203888554, 0.6547321261])

number_slider = Slider(72, range=0..1000)
rectangle = Rectangle(Plane=PlaneXY(0, 0, 0), XSize=number_slider, YSize=number_slider, Radius=0)  # -> Rectangle, Length
divide_surface = DivideSurface(Surface=rectangle.Rectangle, UCount=number_slider, VCount=number_slider)  # -> flatten(Points), Normals, Parameters
boundary = BoundarySurfaces(Edges=rectangle.Rectangle)
surface_from_points = SurfaceFromPoints(Points=divide_surface.Points, UCount=expr("x+1", number_slider), Interpolate=False)
dispatch = Dispatch(List=divide_surface.Points, DispatchPattern=gene_pool)  # -> ListA, ListB
construct_domain = ConstructDomain(DomainStart=0, DomainEnd=height_map)
list_length = ListLength(List=dispatch.ListA)  # -> flatten(Length)
range = Range(Domain=construct_domain, Steps=expr("x-1", list_length))
# Bake me in to RHINO!
unit_z = UnitZ(Factor=range)

# ----
# Optional Jitter
# Node for
# SEED
jitter = Jitter(List=unit_z, Jitter=1, Seed=optional_seed_for_jitter_node)  # -> Values, Indices

multiplication = Multiplication(A=height_map, B=Slider(0.14, range=0..1))
Z = UnitZ(Factor=multiplication)

move = Move(Geometry=boundary, Motion=Z)  # -> Geometry, Transform
point_deform = PointDeform(Geometry=surface_from_points, Points=dispatch.ListA, Motion=jitter.Values)

area = Area(Geometry=move.Geometry)  # -> Area, Centroid
scale = Scale(Geometry=move.Geometry, Center=area.Centroid, Factor=Slider(2, range=0..10))  # -> Geometry, Transform
