# Grasshopper definition Duchame005.gh (Grasshopper 1.0.7)
# plug-ins: Bifocals

optional_seed_for_jitter_node = Slider(27, range=0..100)
uv_point_count = Slider(100, range=0..100)
height_map = Slider(2, range=0..2)

# ----
# Optional Gene Pool
# for Dispatch Pattern
gene_pool = GenePool(
    Decimals=0,
    Maximum=1,
    Minimum=0,
    Value=[0.7781919342, 0.5005636865, 0.6644938833, 0.4016935711, 0.9494723957, 0.8208420462, 0.4284389147, 0.1336825402, 0.07872878531, 0.2197422638, 0.6104933292, 0.1224618853, 0.5840545528, 0.8308359435, 0.7583080031, 0.9942445485, 0.3297216638, 0.04509550289, 0.8307831552, 0.05786600106, 0.3521249012, 0.3204974194, 0.3824567559, 0.764870542, 0.1852175031, 0.1811330482, 0.750880869, 0.5847950674, 0.5203888554, 0.6547321261])

# ----
# Parameters to Play with!
number_slider = Slider(72, range=0..1000)
rectangle = Rectangle(Plane=PlaneXY(0, 0, 0), XSize=number_slider, YSize=number_slider, Radius=0)  # -> Rectangle, Length
divide_surface = DivideSurface(Surface=rectangle.Rectangle, UCount=number_slider, VCount=number_slider)  # -> flatten(Points), Normals, Parameters
boundary_surfaces = BoundarySurfaces(Edges=rectangle.Rectangle)
surface_from_points = SurfaceFromPoints(Points=divide_surface.Points, UCount=expr("x+1", number_slider), Interpolate=False)
dispatch = Dispatch(List=divide_surface.Points, DispatchPattern=gene_pool)  # -> ListA, ListB
construct_domain = ConstructDomain(DomainStart=0, DomainEnd=height_map)
list_length = ListLength(List=dispatch.ListA)  # -> flatten(Length)
range = Range(Domain=construct_domain, Steps=expr("x-1", list_length))
unit_z = UnitZ(Factor=range)
multiplication = Multiplication(A=height_map, B=Slider(0.14, range=0..1))
unit_z_2 = UnitZ(Factor=multiplication)
move = Move(Geometry=boundary_surfaces, Motion=unit_z_2)  # -> Geometry, Transform
area = Area(Geometry=move.Geometry)  # -> Area, Centroid

# ----
# Optional Jitter
# Node for
# SEED
jitter = Jitter(List=unit_z, Jitter=1, Seed=optional_seed_for_jitter_node)  # -> Values, Indices

# ----
# Bake me in to RHINO!
scale = Scale(Geometry=move.Geometry, Center=area.Centroid, Factor=Slider(5, range=0..10))  # -> Geometry, Transform
point_deform = PointDeform(Geometry=surface_from_points, Points=dispatch.ListA, Motion=jitter.Values)

number_slider_2 = Slider(36, range=0..100)
point = Point(divide_surface.Points)
list_length_2 = ListLength(List=number_slider_2)
partition_list = PartitionList(List=point, Size=number_slider_2)
list_item = ListItem(List=partition_list, Index=list_length_2, Wrap=True)
unit_z_3 = UnitZ(Factor=1)
gene_pool_2 = GenePool(
    Decimals=0,
    Maximum=1,
    Minimum=0,
    Value=[0.7915271233, 0.4465030641, 0.2036759027, 0.1057908512, 0.1580188338, 0.7903156915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])
project_point = ProjectPoint(Point=list_item, Direction=unit_z_3, Geometry=point_deform)  # -> flatten(Point), Index
number_slider_3 = Slider(1, range=0..1)
dispatch_2 = Dispatch(List=project_point.Point, DispatchPattern=gene_pool_2)  # -> ListA, ListB
construct_domain_2 = ConstructDomain(DomainStart=Slider(0.1, range=0..0.1), DomainEnd=1)
point_2 = Point(dispatch_2.ListA)
range_2 = Range(Domain=construct_domain_2, Steps=10)
polygon = Polygon(Plane=point_2, Radius=range_2, Segments=Slider(4, range=3..10), FilletRadius=0)  # -> graft(Polygon), Length
area_2 = Area(Geometry=polygon.Polygon)  # -> Area, Centroid
scale_2 = Scale(Geometry=polygon.Polygon, Center=area_2.Centroid, Factor=Slider(0.454, range=0..1))  # -> Geometry, Transform
unit_z_4 = UnitZ(Factor=Slider(1.45, range=0..10))
negative = Negative(Value=unit_z_4)
move_2 = Move(Geometry=scale_2.Geometry, Motion=unit_z_4)  # -> graft(Geometry), Transform
move_3 = Move(Geometry=scale_2.Geometry, Motion=negative)  # -> Geometry, Transform
curve = Curve(move_2.Geometry)
curve_2 = Curve(polygon.Polygon)
curve_3 = Curve(move_3.Geometry)
divide_curve = DivideCurve(Curve=curve_2, Count=10, Kinks=False)  # -> Points, Tangents, Parameters
divide_curve_2 = DivideCurve(Curve=curve, Count=10, Kinks=False)  # -> Points, Tangents, Parameters
divide_curve_3 = DivideCurve(Curve=curve_3, Count=10, Kinks=False)  # -> Points, Tangents, Parameters
line = Line(StartPoint=divide_curve.Points, EndPoint=divide_curve_3.Points)
line_2 = Line(StartPoint=divide_curve_2.Points, EndPoint=divide_curve.Points)
loft = Loft(Curves=line, Options={Adjust=False, Closed=True, LoftEnds=0, LoftSimp=0, LoftType=0, Rebuild=10, Refit=0.01})
loft_2 = Loft(Curves=line_2, Options={Adjust=False, Closed=True, LoftEnds=0, LoftSimp=0, LoftType=0, Rebuild=10, Refit=0.01})
brep = Brep(loft_2)
brep_2 = Brep(loft)
cap_holes = CapHoles(Brep=brep_2)
cap_holes_2 = CapHoles(Brep=brep)
unit_x = UnitX(Factor=1)
solid_union = SolidUnion(Breps=[cap_holes_2, cap_holes])  # -> graft(Result)
volume = Volume(Geometry=solid_union)  # -> Volume, Centroid
move_4 = Move(Geometry=solid_union, Motion=unit_x)  # -> Geometry, Transform
polar_array = PolarArray(Geometry=move_4.Geometry, Plane=volume.Centroid, Count=Slider(4, range=0..10), Angle=Slider(10, range=0..10))  # -> Geometry, Transform

point_3 = Point(flatten(area_2.Centroid))
interpolate = Interpolate(Vertices=point_3, Degree=3, Periodic=False, KnotStyle=1)  # -> Curve, Length, Domain
divide_curve_4 = DivideCurve(Curve=interpolate.Curve, Count=Slider(1000, range=0..1000), Kinks=False)  # -> Points, Tangents, Parameters
unit_z_5 = UnitZ(Factor=Slider(3, range=1..3))
negative_2 = Negative(Value=unit_z_5)
move_5 = Move(Geometry=divide_curve_4.Points, Motion=negative_2)  # -> Geometry, Transform
line_3 = Line(StartPoint=divide_curve_4.Points, EndPoint=move_5.Geometry)

# ----
# Bake me in to RHINO!
pipe = Pipe(Curve=[interpolate.Curve, line_3], Radius=Slider(0.08, range=0..1), Caps=0)

# ----
# Bake me in to RHINO!
solid_union_2 = SolidUnion(Breps=polar_array.Geometry)
