# Grasshopper definition February23rdGlasses.gh (Grasshopper 1.0.7)
# plug-ins: Starfish, Bifocals

# ----
# Create a Curve in Rhino
# starting at 0,0,0 and draw
# out and up a shape of half
# a vessel or form.
# 
# Play with divide count and offset # sliders
# 
# Bake
# 
# 3D print
curve = Curve(<curve referenced from the Rhino model>)

number_slider = Slider(14, range=0..100)
offset_curve = OffsetCurve(
    Curve=curve,
    Distance=expr("-x", Slider(3, range=0.01..3)),
    Plane=PlaneXY(0, 0, 0),
    Corner=1,
    BothSides=False,
    Side=False,
    Cap=0)
divide_curve = DivideCurve(Curve=curve, Count=number_slider, Kinks=False)  # -> Points, Tangents, Parameters
divide_curve_2 = DivideCurve(Curve=offset_curve, Count=number_slider, Kinks=False)  # -> Points, Tangents, Parameters
list_item = ListItem(List=reverse(divide_curve.Points), Index=0, Wrap=True)
list_item_2 = ListItem(List=divide_curve_2.Points, Index=0, Wrap=True)
list_item_3 = ListItem(List=reverse(divide_curve_2.Points), Index=0, Wrap=True)
list_item_4 = ListItem(List=divide_curve.Points, Index=0, Wrap=True)
interpolate = Interpolate(Vertices=divide_curve_2.Points, Degree=3, Periodic=False, KnotStyle=1)  # -> Curve, Length, Domain
line = Line(StartPoint=list_item_3, EndPoint=list_item)
interpolate_2 = Interpolate(Vertices=divide_curve.Points, Degree=3, Periodic=False, KnotStyle=1)  # -> Curve, Length, Domain
line_2 = Line(StartPoint=list_item_2, EndPoint=list_item_4)
line_sdl = LineSDL(Start=Point(0, 0, 0), Direction=Vector(0, 0, 1), Length=1)
merge = Merge(Data1=[line_2, line, interpolate.Curve, interpolate_2.Curve])

# ----
# Bake Me into Rhino
revolution = Revolution(Curve=merge, Axis=line_sdl, Domain=Domain(0, 6.283185307))
