# Grasshopper definition February23rdPipedTower.gh (Grasshopper 1.0.7)
# plug-ins: Bifocals

# ----
# Create a Curve in Rhino
# starting at 0,0,0
# ending at 0,0,z
# Create and Arc in Rhino
# starting at 0,0,0
curve = Curve(<curve referenced from the Rhino model>)
curve_2 = Curve(<curve referenced from the Rhino model>)

md_slider = MDSlider(SliderMode=0, slider_value=Point(0.5, 0.5, 0.5), x_domain=Domain(0, 1), y_domain=Domain(0, 1), z_domain=Domain(0, 1))
line = Line(StartPoint=Point(0, 0, 0), EndPoint=Point(0, 0, 1))
pi = Pi(Factor=Slider(1.408, range=0..2))
construct_domain = ConstructDomain(DomainStart=Slider(1, range=0..1), DomainEnd=Slider(106, range=60..120))
construct_domain_2 = ConstructDomain(DomainStart=Slider(2.2, range=0.9..2.2), DomainEnd=Slider(0.6, range=0.6..1.2))
construct_domain_3 = ConstructDomain(DomainStart=Slider(1, range=0..1), DomainEnd=Slider(360, range=0..360))
revolution = Revolution(Curve=curve, Axis=line, Domain=pi)
range = Range(Domain=construct_domain, Steps=10)
range_2 = Range(Domain=construct_domain_2, Steps=10)
range_3 = Range(Domain=construct_domain_3, Steps=10)
unit_z = UnitZ(Factor=range)
move = Move(Geometry=revolution, Motion=unit_z)  # -> Geometry, Transform
area = Area(Geometry=move.Geometry)  # -> Area, Centroid
scale = Scale(Geometry=move.Geometry, Center=area.Centroid, Factor=range_2)  # -> Geometry, Transform
rotate = Rotate(Geometry=scale.Geometry, Angle=range_3, Plane=PlaneXY(0, 0, 0))  # -> Geometry, Transform
evaluate_surface = EvaluateSurface(Surface=rotate.Geometry, Point=md_slider)  # -> Point, Normal, UDirection, VDirection, Frame
extrude = Extrude(Base=rotate.Geometry, Direction=evaluate_surface.Normal)

bend_deform = BendDeform(Geometry=extrude, BendingArc=curve_2)

area_2 = Area(Geometry=bend_deform)  # -> Area, Centroid
interpolate = Interpolate(Vertices=area_2.Centroid, Degree=3, Periodic=False, KnotStyle=1)  # -> Curve, Length, Domain

# ----
# Disable Prior to Playing with Sliders
# Bake Both Extrusions and Pipe
pipe = Pipe(Curve=interpolate.Curve, Radius=Slider(2.536, range=1..3), Caps=2)
