# Grasshopper definition February23rdTest.gh (Grasshopper 1.0.7)
# plug-ins: Bifocals

number_slider = Slider(26, range=0..100)
ellipse = Ellipse(Plane=PlaneXY(0, 0, 0), Radius1=Slider(15, range=0..100), Radius2=Slider(19, range=0..100))  # -> Ellipse, Focus1, Focus2
divide_curve = DivideCurve(Curve=ellipse.Ellipse, Count=number_slider, Kinks=False)  # -> Points, Tangents, Parameters
partition_list = PartitionList(List=divide_curve.Points, Size=expr("x/3", number_slider))
unit_z = UnitZ(Factor=Slider(12, range=0..100))
list_item = ListItem(List=partition_list, Index=Slider(5, range=0..10), Wrap=True)
move = Move(Geometry=list_item, Motion=unit_z)  # -> flatten(Geometry), Transform
interpolate = Interpolate(Vertices=move.Geometry, Degree=3, Periodic=True, KnotStyle=1)  # -> Curve, Length, Domain
loft = Loft(
    Curves=[interpolate.Curve, ellipse.Ellipse],
    Options={Adjust=False, Closed=False, LoftEnds=0, LoftSimp=0, LoftType=0, Rebuild=10, Refit=0.01})
