# Grasshopper definition February24th.gh (Grasshopper 1.0.7)
# plug-ins: Bifocals

number_slider = Slider(6, range=0..10)
curve = Curve(<curve referenced from the Rhino model>)
area = Area(Geometry=curve)  # -> Area, Centroid
offset_curve = OffsetCurve(Curve=curve, Distance=Slider(-2.23, range=-3..3), Plane=PlaneXY(0, 0, 0), Corners=1)
divide_curve = DivideCurve(Curve=curve, Count=number_slider, Kinks=False)  # -> Points, Tangents, Parameters
divide_curve_2 = DivideCurve(Curve=offset_curve, Count=number_slider, Kinks=False)  # -> Points, Tangents, Parameters
dispatch = Dispatch(List=divide_curve.Points, DispatchPattern=[True, False])  # -> ListA, ListB
line = Line(StartPoint=divide_curve_2.Points, EndPoint=divide_curve.Points)
line_2 = Line(StartPoint=area.Centroid, EndPoint=dispatch.ListA)
yz_plane = YZPlane(Origin=Point(0, 0, 0))
pi = Pi(Factor=Slider(-0.1, range=-1..0.5))
merge = Merge(Data1=line_2, Data2=line, Data3=offset_curve, Data4=curve)  # -> flatten(Result)
rotate_3d = Rotate3D(Geometry=merge, Angle=pi, Center=area.Centroid, Axis=yz_plane)  # -> Geometry, Transform
unit_y = UnitY(Factor=Slider(8, range=0..10))
unit_z = UnitZ(Factor=Slider(2.88, range=-3..6))
xz_plane = XZPlane(Origin=Point(0, 0, 0))
move = Move(Geometry=area.Centroid, Motion=unit_y)  # -> Geometry, Transform
move_2 = Move(Geometry=area.Centroid, Motion=unit_z)  # -> Geometry, Transform
move_3 = Move(Geometry=[rotate_3d.Geometry, area.Centroid], Motion=unit_y)  # -> Geometry, Transform
mirror = Mirror(Geometry=move.Geometry, Plane=xz_plane)  # -> Geometry, Transform
mirror_2 = Mirror(Geometry=move_3.Geometry, Plane=xz_plane)  # -> Geometry, Transform
arc_3pt = Arc3Pt(PointA=move.Geometry, PointB=move_2.Geometry, PointC=mirror.Geometry)  # -> Arc, Plane, Radius
point_on_curve = PointOnCurve(arc_3pt.Arc, parameter=0.352)
unit_z_2 = UnitZ(Factor=Slider(1.26, range=0..2))
point = Point(point_on_curve)
move_4 = Move(Geometry=point, Motion=expr("-x", unit_z_2))  # -> Geometry, Transform
circle_cnr = CircleCNR(Center=point, Normal=move_4.Geometry, Radius=Slider(1.615, range=0..3))
point_on_curve_2 = PointOnCurve(circle_cnr, parameter=0.333)
line_3 = Line(StartPoint=point_on_curve, EndPoint=point_on_curve_2)
line_sdl = LineSDL(Start=point_on_curve, Direction=line_3, Length=Slider(28, range=0..100))
mirror_3 = Mirror(Geometry=[circle_cnr, line_sdl], Plane=xz_plane)  # -> Geometry, Transform
pipe = Pipe(
    Curve=[mirror_3.Geometry, line_sdl, circle_cnr, move_3.Geometry, mirror_2.Geometry, arc_3pt.Arc],
    Radius=Slider(0.54, range=0..1),
    Caps=2)
