# Grasshopper definition GUID.gh (Grasshopper 1.0.7)

number_slider = Slider(10, range=0..10)
unit_x = UnitX(Factor=1)
construct_point = ConstructPoint(XCoordinate=Slider(0, range=0..10), YCoordinate=Slider(0, range=0..10), ZCoordinate=Slider(0, range=0..10))
unit_z = UnitZ(Factor=number_slider)
rectangle = Rectangle(Plane=construct_point, XSize=number_slider, YSize=number_slider, Radius=0)  # -> Rectangle, Length
ghpython_script = GhPythonScript(x=unit_x)  # -> out, a
# ---------- ghpython_script: Python ----------
__author__ = "mwickerson"
__version__ = "2019.10.15"

import rhinoscriptsyntax as rs
for input in ghenv.Component.Params.Input:
    for source in input.Sources:
        a = str(source.InstanceGuid)
# ---------- end ghpython_script ----------
move = Move(Geometry=rectangle.Rectangle, Motion=unit_z)  # -> Geometry, Transform
panel = Panel(ghpython_script.a)
area = Area(Geometry=move.Geometry)  # -> Area, Centroid
scale = Scale(Geometry=move.Geometry, Center=area.Centroid, Factor=expr("x/10", Slider(8, range=1..10)))  # -> Geometry, Transform
radians = Radians(Degrees=expr("x*10", Slider(7, range=0..10)))
rotate = Rotate(Geometry=scale.Geometry, Angle=expr("x*10", radians), Plane=area.Centroid)  # -> Geometry, Transform
loft = Loft(
    Curves=[rotate.Geometry, rectangle.Rectangle],
    Options={Adjust=False, Closed=False, LoftEnds=0, LoftSimp=0, LoftType=0, Rebuild=10, Refit=0.01})
cap_holes = CapHoles(Brep=loft)
