# Grasshopper definition GUIDHepertWalker002.gh (Grasshopper 1.0.7)
# plug-ins: Bifocals

ghpython_script = GhPythonScript(seed=Slider(23, range=0..100), time=Slider(1935, range=0..10000))  # -> out, a; inputs time: Int32
# ---------- ghpython_script: Python ----------
__author__ = "Sculpture"
__version__ = "2019.10.18"

import rhinoscriptsyntax as rs
#randomness
import random as r
r.seed(seed) #functionname and function variable



#class
class Walker:
    
    def __init__(self):
        self.x = 0 #initialize it
        self.y = 0
        
        
    def point(self):
        shape = rs.AddPoint(self.x, self.y, 0)
        return shape
    
    def step(self):
        choice = r.randint(0,3) #returns 0, 1, 2, or 3
        if(choice == 0):
            self.x = self.x + 1
        elif(choice == 1):
            self.x = self.x - 1
        elif(choice == 2):
            self.y = self.y + 1
        else:
            self.y = self.y - 1



#time
w = Walker()


pList = []
for t in range(time):
    w.step()
    pList.append(w.point())

a = pList
print pList
# ---------- end ghpython_script ----------
point = Point(ghpython_script.a)
mesh_sphere = MeshSphere(Base=point, Radius=Slider(0.4, range=0..1), UCount=10, VCount=20)
panel = Panel(ghpython_script.a)
