# Grasshopper definition GUIDHepertWalker002WheelBarrow.gh (Grasshopper 1.0.7)
# plug-ins: Bifocals

ghpython_script = GhPythonScript(seed=Slider(44, range=0..100), time=Slider(793, range=-1..1000))  # -> out, a; inputs time: Int32
# ---------- ghpython_script: Python ----------
__author__ = "Sculpture"
__version__ = "2019.10.18"

import rhinoscriptsyntax as rs
#randomness
import random as r
r.seed(seed) #functionname and function variable



#class
class Walker:
    
    def __init__(self):
        self.x = 0 #initialize it
        self.y = 0
        self.z = 0
        
    def point(self):
        shape = rs.AddPoint(self.x, self.y, self.z)
        return shape
    
    def step(self):
        stepX = r.uniform(-1,1.11)
        stepY = r.uniform(-1,1)
        stepZ = r.uniform(-1,1)
        
        self.x += stepX
        self.y += stepY
        self.z += stepZ
        



#time
w = Walker()


pList = []
for t in range(time):
    w.step()
    pList.append(w.point())

a = pList
print pList
# ---------- end ghpython_script ----------
point = Point(ghpython_script.a)
rectangle = Rectangle(Plane=point, XSize=Domain(-1, 1), YSize=Domain(-2, 2), Radius=0)  # -> Rectangle, Length
box_rectangle = BoxRectangle(Rectangle=rectangle.Rectangle, Height=Slider(3, range=0..10))
panel = Panel(ghpython_script.a)
