# Grasshopper definition GUIDWheelBarrow.gh (Grasshopper 1.0.7)
# plug-ins: Bifocals

number_slider = Slider(10, range=0..10)
construct_point = ConstructPoint(XCoordinate=Slider(323, range=0..1200), YCoordinate=Slider(306, range=0..1200), ZCoordinate=Slider(0, range=0..10))
unit_z = UnitZ(Factor=number_slider)
rectangle = Rectangle(Plane=construct_point, XSize=number_slider, YSize=number_slider, Radius=0)  # -> Rectangle, Length
move = Move(Geometry=rectangle.Rectangle, Motion=unit_z)  # -> Geometry, Transform
area = Area(Geometry=move.Geometry)  # -> Area, Centroid
scale = Scale(Geometry=move.Geometry, Center=area.Centroid, Factor=expr("x/3", Slider(19, range=1..110)))  # -> Geometry, Transform
radians = Radians(Degrees=Slider(10, range=0..10))
rotate = Rotate(Geometry=scale.Geometry, Angle=expr("x*10", radians), Plane=area.Centroid)  # -> Geometry, Transform
loft = Loft(
    Curves=[rotate.Geometry, rectangle.Rectangle],
    Options={Adjust=False, Closed=False, LoftEnds=0, LoftSimp=0, LoftType=0, Rebuild=10, Refit=0.01})
cap_holes = CapHoles(Brep=loft)
geometry = Geometry(<mesh referenced from the Rhino model>)
geometry_2 = Geometry(<brep referenced from the Rhino model>)
box_morph = BoxMorph(Geometry=geometry, Reference=geometry_2, Target=cap_holes)
ghpython_script = GhPythonScript(x=box_morph)  # -> out, a
# ---------- ghpython_script: Python ----------
__author__ = "mwickerson"
__version__ = "2019.10.15"

import rhinoscriptsyntax as rs
for input in ghenv.Component.Params.Input:
    for source in input.Sources:
        a = str(source.InstanceGuid)
# ---------- end ghpython_script ----------
panel = Panel(ghpython_script.a)
