# Grasshopper definition HepertGauss003.gh (Grasshopper 1.0.7)
# plug-ins: Bifocals

gauss = GhPythonScript(seed=Slider(3, range=0..10), count=Slider(120, range=0..1000), mean=Slider(0, range=0..100), sd=Slider(53, range=0..100))  # -> out, a; inputs count: Int32
# ---------- gauss: Python ----------
__author__ = "Sculpture"
__version__ = "2019.10.19"

import rhinoscriptsyntax as rs
import random as r
r.seed(seed)

list = []
for c in range(count):
    rand = r.gauss(mean, sd)
    list.append(rand)
    
a = list
# ---------- end gauss ----------
gauss_2 = GhPythonScript(
    seed=Slider(8, range=0..10),
    count=Slider(120, range=0..1000),
    mean=Slider(12, range=0..100),
    sd=Slider(10, range=0..100))  # -> out, a; inputs count: Int32; same code as gauss
gauss_3 = GhPythonScript(
    seed=Slider(6, range=0..10),
    count=Slider(120, range=0..1000),
    mean=Slider(12, range=0..100),
    sd=Slider(29, range=0..100))  # -> out, a; inputs count: Int32; same code as gauss
pt = ConstructPoint(XCoordinate=gauss.a, YCoordinate=gauss_2.a, ZCoordinate=gauss_3.a)
voronoi³ = Voronoi3D(Points=pt)  # -> Cells, Boundary
