# Grasshopper definition March1stIsabella010.gh (Grasshopper 1.0.7)
# plug-ins: Pufferfish, Bifocals

beam_width_depth = Slider(1.68, range=0..10)
beam_angle = Slider(38, range=0..100)
beam_angle_2 = Slider(-0.001, range=-0.001..0.23)
beam_height = Slider(100, range=0..100)

wheel_rotation = Slider(0.473, range=0..1)
spoke_length = Slider(100, range=0..100)
elipse_dim_1 = Slider(2.93, range=0..10)
ellipse_dim_2 = Slider(10, range=0..10)
wheel_perpf = Slider(10, range=0..10)
spoke_radii = Slider(10, range=0..10)

landing_platform_height = Slider(8, range=0..100)
scale = Slider(0.62, range=0..1)

number_slider = Slider(35, range=0..100)
# Rope Bend
number_slider_2 = Slider(89, range=0..100)

# ----
# Clapper
number_slider_3 = Slider(86, range=0..100)

number_slider_4 = Slider(1.2, range=0..2)
# Rope
number_slider_5 = Slider(-7, range=-7..0)

integer = Integer(4)
integer_2 = Integer(1)
polygon = Polygon(Plane=PlaneXY(0, 0, 0), Radius=beam_width_depth, Segments=integer, FilletRadius=0)  # -> Polygon, Length
unit_x = UnitX(Factor=beam_angle)
construct_point = ConstructPoint(XCoordinate=0, YCoordinate=integer_2, ZCoordinate=0)
construct_point_2 = ConstructPoint(XCoordinate=0, YCoordinate=0, ZCoordinate=0)
unit_x_2 = UnitX(Factor=Slider(6, range=0..10))
unit_y = UnitY(Factor=Slider(159, range=0..300))
construct_point_3 = ConstructPoint(XCoordinate=0, YCoordinate=Slider(244, range=0..400), ZCoordinate=0)
move = Move(Geometry=polygon.Polygon, Motion=unit_x)  # -> Geometry, Transform
unit_z = UnitZ(Factor=Slider(100, range=0..200))
area = Area(Geometry=move.Geometry)  # -> Area, Centroid
line = Line(StartPoint=construct_point_2, EndPoint=construct_point)
move_2 = Move(Geometry=construct_point_3, Motion=unit_z)  # -> Geometry, Transform
integer_3 = Integer(expr("1", 1))
pi = Pi(Factor=beam_angle_2)
construct_point_4 = ConstructPoint(XCoordinate=0, YCoordinate=integer_3, ZCoordinate=0)
construct_point_5 = ConstructPoint(XCoordinate=0, YCoordinate=0, ZCoordinate=0)
unit_z_2 = UnitZ(Factor=Slider(14, range=0..100))
rotate_3d = Rotate3D(Geometry=move.Geometry, Angle=expr("-x", pi), Center=area.Centroid, Axis=line)  # -> Geometry, Transform
pi_2 = Pi(Factor=Slider(0.22, range=0..1))
line_2 = Line(StartPoint=construct_point_5, EndPoint=construct_point_4)
construct_point_6 = ConstructPoint(XCoordinate=0, YCoordinate=Slider(1, range=0..1), ZCoordinate=0)
md_slider = MDSlider(SliderMode=0, slider_value=Point(0.5, 0.5, 0.5), x_domain=Domain(0, 1), y_domain=Domain(0, 1), z_domain=Domain(0, 1))
pi_3 = Pi(Factor=wheel_rotation)
boundary_surfaces = BoundarySurfaces(Edges=rotate_3d.Geometry)
unit_z_3 = UnitZ(Factor=landing_platform_height)
evaluate_surface = EvaluateSurface(Surface=boundary_surfaces, Point=md_slider)  # -> Point, Normal, UDirection, VDirection, Frame
point = Point(evaluate_surface.Point)
move_3 = Move(Geometry=point, Motion=unit_y)  # -> Geometry, Transform
line_3 = Line(StartPoint=point, EndPoint=move_3.Geometry)
move_4 = Move(Geometry=line_3, Motion=unit_x_2)  # -> Geometry, Transform
arc_3pt = Arc3Pt(PointA=point, PointB=move_3.Geometry, PointC=construct_point_3)  # -> Arc, Plane, Radius
point_on_curve = PointOnCurve(arc_3pt.Arc, parameter=0.27)
loft = Loft(
    Curves=[line_3, move_4.Geometry],
    Options={Adjust=False, Closed=False, LoftEnds=0, LoftSimp=0, LoftType=0, Rebuild=10, Refit=0.01})
extrude = Extrude(Base=loft, Direction=unit_z_2)
rotate_3d_2 = Rotate3D(Geometry=extrude, Angle=pi_2, Center=point, Axis=construct_point_6)  # -> Geometry, Transform
construct_domain = ConstructDomain(DomainStart=0, DomainEnd=Slider(2, range=0..2))
unit_z_4 = UnitZ(Factor=beam_height)
construct_domain_2 = ConstructDomain(DomainStart=Slider(1, range=0..1), DomainEnd=Slider(100, range=0..100))
bend_deform = BendDeform(Geometry=rotate_3d_2.Geometry, BendingArc=arc_3pt.Arc)
multiplication = Multiplication(A=evaluate_surface.Normal, B=beam_height)
range = Range(Domain=construct_domain, Steps=Slider(5, range=0..10))
range_2 = Range(Domain=construct_domain_2, Steps=10)
extrude_2 = Extrude(Base=rotate_3d.Geometry, Direction=multiplication)
construct_domain_3 = ConstructDomain(DomainStart=Slider(0, range=0..100), DomainEnd=Slider(2, range=0..10))
pi_4 = Pi(Factor=range)
unit_z_5 = UnitZ(Factor=range_2)
cap_holes = CapHoles(Brep=extrude_2)
move_5 = Move(Geometry=bend_deform, Motion=unit_z_5)  # -> Geometry, Transform
arc_3pt_2 = Arc3Pt(PointA=point, PointB=point_on_curve, PointC=move_2.Geometry)  # -> Arc, Plane, Radius
range_3 = Range(Domain=construct_domain_3, Steps=integer)
dispatch = Dispatch(List=move_5.Geometry, DispatchPattern=[True, False])  # -> ListA, ListB
pi_5 = Pi(Factor=range_3)
rotate_3d_3 = Rotate3D(Geometry=cap_holes, Angle=pi_5, Center=Point(0, 0, 0), Axis=Vector(0, 0, 1))  # -> Geometry, Transform
rotate_3d_4 = Rotate3D(Geometry=cap_holes, Angle=pi_5, Center=Point(0, 0, 0), Axis=Vector(0, 0, 1))  # -> Geometry, Transform
xz_plane = XZPlane(Origin=Point(0, 0, 0))
bend_deform_2 = BendDeform(Geometry=dispatch.ListA, BendingArc=arc_3pt_2.Arc)
construct_domain_4 = ConstructDomain(DomainStart=0, DomainEnd=expr("x-1", integer))
mirror = Mirror(Geometry=bend_deform_2, Plane=PlaneYZ(0, 0, 0))  # -> Geometry, Transform
mirror_2 = Mirror(Geometry=[bend_deform_2, mirror.Geometry], Plane=xz_plane)  # -> Geometry, Transform
solid_union = SolidUnion(Breps=[bend_deform_2, mirror.Geometry, mirror_2.Geometry])
construct_point_7 = ConstructPoint(XCoordinate=0, YCoordinate=0, ZCoordinate=expr("-x", Slider(49, range=0..100)))
construct_point_8 = ConstructPoint(XCoordinate=number_slider_2, YCoordinate=0, ZCoordinate=0)
construct_point_9 = ConstructPoint(XCoordinate=0, YCoordinate=number_slider, ZCoordinate=expr("-x", number_slider))
scale_2 = Scale(Geometry=solid_union, Center=Point(0, 0, 0), Factor=Slider(1.64, range=0..10))  # -> Geometry, Transform
arc_3pt_3 = Arc3Pt(PointA=construct_point_8, PointB=construct_point_7, PointC=construct_point_9)  # -> Arc, Plane, Radius
scale_nu = ScaleNU(
    Geometry=scale_2.Geometry,
    Plane=PlaneXY(0, 0, 0),
    ScaleX=Slider(0.379, range=0..2.5),
    ScaleY=Slider(0.762, range=0..2.5),
    ScaleZ=Slider(0.478, range=0..2.5))  # -> Geometry, Transform
unit_z_6 = UnitZ(Factor=Slider(47, range=0..100))
move_6 = Move(Geometry=scale_nu.Geometry, Motion=unit_z_6)  # -> Geometry, Transform
curve = Curve(<curve referenced from the Rhino model>)

# ----
# Bell Top and Bottom Shape
number_slider_6 = Slider(26, range=0..100)
number_slider_7 = Slider(10, range=0..10)

unit_x_3 = UnitX(Factor=Slider(35, range=0..100))
unit_x_4 = UnitX(Factor=Slider(5, range=0..10))
unit_z_7 = UnitZ(Factor=number_slider_6)
pi_6 = Pi(Factor=Slider(0.52, range=0..2))

rotate_3d_5 = Rotate3D(Geometry=cap_holes, Angle=pi_5, Center=Point(0, 0, 0), Axis=Vector(0, 0, 1))  # -> Geometry, Transform

sub_list = SubList(List=rotate_3d_5.Geometry, Domain=construct_domain_4, Wrap=True)  # -> List, Index
brep = Brep(sub_list.List)
deconstruct_brep = DeconstructBrep(Brep=brep)  # -> Faces, Edges, Vertices
list_item = ListItem(List=deconstruct_brep.Vertices, Index=Slider(1, range=0..10), Wrap=True)  # -> flatten(Item)
list_item_2 = ListItem(List=deconstruct_brep.Vertices, Index=Slider(1, range=0..10), Wrap=True)  # -> flatten(Item)
list_item_3 = ListItem(List=deconstruct_brep.Vertices, Index=Slider(4, range=0..10), Wrap=True)  # -> flatten(Item)
dispatch_2 = Dispatch(List=list_item_2, DispatchPattern=[True, False])  # -> ListA, ListB
dispatch_3 = Dispatch(List=list_item, DispatchPattern=[True, False])  # -> ListA, ListB
dispatch_4 = Dispatch(List=list_item_3, DispatchPattern=[True, False])  # -> ListA, ListB
dispatch_5 = Dispatch(List=dispatch_3.ListB, DispatchPattern=[True, False])  # -> ListA, ListB
dispatch_6 = Dispatch(List=dispatch_3.ListA, DispatchPattern=[True, False])  # -> ListA, ListB
dispatch_7 = Dispatch(List=dispatch_3.ListB, DispatchPattern=[True, False])  # -> ListA, ListB
dispatch_8 = Dispatch(List=dispatch_3.ListA, DispatchPattern=[True, False])  # -> ListA, ListB
circle_cnr = CircleCNR(Center=dispatch_4.ListA, Normal=Vector(0, 0, 1), Radius=spoke_length)
line_4 = Line(StartPoint=dispatch_2.ListA, EndPoint=dispatch_2.ListB)
line_5 = Line(StartPoint=dispatch_6.ListB, EndPoint=dispatch_5.ListA)
line_6 = Line(StartPoint=dispatch_8.ListA, EndPoint=dispatch_7.ListB)
dispatch_9 = Dispatch(List=circle_cnr, DispatchPattern=[True, False])  # -> ListA, ListB
dispatch_10 = Dispatch(List=dispatch_4.ListA, DispatchPattern=[True, False])  # -> ListA, ListB
boundary_surfaces_2 = BoundarySurfaces(Edges=[line_4, line_6, line_5])
area_2 = Area(Geometry=boundary_surfaces_2)  # -> Area, Centroid
point_2 = Point(area_2.Centroid)
construct_domain_5 = ConstructDomain(DomainStart=point_2, DomainEnd=number_slider_5)
move_7 = Move(Geometry=area_2.Centroid, Motion=expr("-x", unit_z_7))  # -> Geometry, Transform
move_8 = Move(Geometry=move_7.Geometry, Motion=unit_x_3)  # -> Geometry, Transform
range_4 = Range(Domain=construct_domain_5, Steps=Slider(33, range=0..100))
cosine = Cosine(Value=range_4)
sine = Sine(Value=range_4)
extrude_3 = Extrude(Base=boundary_surfaces_2, Direction=unit_z_3)
extrude_4 = Extrude(Base=boundary_surfaces_2, Direction=unit_z_3)
multiplication_2 = Multiplication(A=sine, B=number_slider_4)
multiplication_3 = Multiplication(A=cosine, B=number_slider_4)
line_7 = Line(StartPoint=area_2.Centroid, EndPoint=move_8.Geometry)

point_on_curve_2 = PointOnCurve(line_7, parameter=0)

move_9 = Move(Geometry=point_on_curve_2, Motion=unit_x_4)  # -> Geometry, Transform
construct_point_10 = ConstructPoint(XCoordinate=multiplication_2, YCoordinate=multiplication_3, ZCoordinate=range_4)
list_item_4 = ListItem(List=construct_point_10, Index=number_slider_3, Wrap=True)
arc_3pt_4 = Arc3Pt(PointA=area_2.Centroid, PointB=move_9.Geometry, PointC=move_8.Geometry)  # -> Arc, Plane, Radius
interpolate = Interpolate(Vertices=construct_point_10, Degree=3, Periodic=False, KnotStyle=1)  # -> Curve, Length, Domain
cone = Cone(Base=list_item_4, Radius=Slider(7, range=0..10), Length=Slider(46, range=0..100))  # -> Cone, Tip
offset_surface = OffsetSurface(Surface=cone.Cone, Distance=1, BothSides=False, CreateSolid=True)
offset_surface_2 = OffsetSurface(Surface=cone.Cone, Distance=1, BothSides=False, CreateSolid=True)
rotate_3d_6 = Rotate3D(Geometry=dispatch_9.ListA, Angle=pi_3, Center=dispatch_10.ListA, Axis=line_2)  # -> Geometry, Transform
perp_frames = PerpFrames(Curve=rotate_3d_6.Geometry, Count=wheel_perpf, Align=True)  # -> Frames, Parameters
pipe = Pipe(Curve=interpolate.Curve, Radius=Slider(0.64, range=0..2), Caps=0)
rotate_3d_7 = Rotate3D(Geometry=pipe, Angle=pi_4, Center=Point(0, 0, 0), Axis=Vector(0, 0, 1))  # -> Geometry, Transform
rotate_3d_8 = Rotate3D(Geometry=pipe, Angle=pi_4, Center=Point(0, 0, 0), Axis=Vector(0, 0, 1))  # -> Geometry, Transform
rotate_3d_9 = Rotate3D(Geometry=arc_3pt_4.Arc, Angle=pi_6, Center=move_8.Geometry, Axis=Vector(0, 20.00224754, 0))  # -> Geometry, Transform
ellipse = Ellipse(Plane=perp_frames.Frames, Radius1=elipse_dim_1, Radius2=ellipse_dim_2)  # -> Ellipse, Focus1, Focus2
area_3 = Area(Geometry=rotate_3d_6.Geometry)  # -> Area, Centroid
divide_curve = DivideCurve(Curve=rotate_3d_6.Geometry, Count=wheel_perpf, Kinks=False)  # -> Points, Tangents, Parameters
scale_3 = Scale(Geometry=rotate_3d_9.Geometry, Center=move_8.Geometry, Factor=Slider(1, range=0..1))  # -> Geometry, Transform
line_8 = Line(StartPoint=area_3.Centroid, EndPoint=divide_curve.Points)
merge = Merge(Data1=scale_3.Geometry, Data2=arc_3pt_4.Arc)
revolution = Revolution(Curve=merge, Axis=Line((0, 0, 0), (0, 0, 44.11065724)), Domain=Domain(0, 6.283185307))
offset_surface_3 = OffsetSurface(Surface=revolution, Distance=number_slider_7, BothSides=False, CreateSolid=True)
offset_surface_4 = OffsetSurface(Surface=revolution, Distance=number_slider_7, BothSides=False, CreateSolid=True)
merge_2 = Merge(Data1=rotate_3d_4.Geometry, Data2=extrude_4, Data3=offset_surface_4, Data4=rotate_3d_8.Geometry, Data5=offset_surface_2)
scale_4 = Scale(Geometry=merge_2, Center=Point(0, 0, 0), Factor=scale)  # -> Geometry, Transform
dispatch_11 = Dispatch(List=revolution, DispatchPattern=[True, False])  # -> ListA, ListB
rotate_3d_10 = Rotate3D(Geometry=pipe, Angle=pi_4, Center=Point(0, 0, 0), Axis=Vector(0, 0, 1))  # -> Geometry, Transform

bend_deform_3 = BendDeform(Geometry=rotate_3d_10.Geometry, BendingArc=arc_3pt_3.Arc)
move_10 = Move(Geometry=scale_4.Geometry, Motion=unit_z_4)  # -> Geometry, Transform
extrude_5 = Extrude(Base=boundary_surfaces_2, Direction=unit_z_3)
offset_surface_5 = OffsetSurface(Surface=revolution, Distance=number_slider_7, BothSides=False, CreateSolid=True)
offset_surface_6 = OffsetSurface(Surface=cone.Cone, Distance=1, BothSides=False, CreateSolid=True)
pipe_2 = Pipe(Curve=line_8, Radius=expr("x/2", spoke_radii), Caps=0)
sphere = Sphere(Base=area_3.Centroid, Radius=spoke_radii)
mirror_3 = Mirror(Geometry=[sphere, pipe_2], Plane=PlaneYZ(0, 0, 0))  # -> Geometry, Transform
loft_2 = Loft(Curves=ellipse.Ellipse, Options={Adjust=False, Closed=True, LoftEnds=0, LoftSimp=0, LoftType=0, Rebuild=10, Refit=0.01})
mirror_4 = Mirror(Geometry=loft_2, Plane=PlaneYZ(0, 0, 0))  # -> Geometry, Transform

brep_2 = Brep([mirror_3.Geometry, sphere, pipe_2, loft_2, mirror_4.Geometry, rotate_3d_5.Geometry, extrude_5, offset_surface_5, offset_surface_6, move_10.Geometry, bend_deform_3])
bend_deform_4 = BendDeform(Geometry=brep_2, BendingArc=curve)  # disabled
