# Grasshopper definition March1stKlokkenlimp.gh (Grasshopper 1.0.7)
# plug-ins: Pufferfish, Bifocals

number_slider = Slider(100, range=0..100)
number_slider_2 = Slider(6.65, range=0..10)
number_slider_3 = Slider(3, range=0..10)
number_slider_4 = Slider(5.7, range=0..10)
number_slider_5 = Slider(19, range=0..100)
number_slider_6 = Slider(1, range=0..2)
integer = Integer(4)
integer_2 = Integer(1)
polygon = Polygon(Plane=PlaneXY(0, 0, 0), Radius=Slider(6.14, range=0..10), Segments=integer, FilletRadius=0)  # -> Polygon, Length
unit_x = UnitX(Factor=Slider(68, range=0..100))
construct_point = ConstructPoint(XCoordinate=0, YCoordinate=integer_2, ZCoordinate=0)
construct_point_2 = ConstructPoint(XCoordinate=0, YCoordinate=0, ZCoordinate=0)
unit_x_2 = UnitX(Factor=Slider(18, range=0..100))
unit_x_3 = UnitX(Factor=Slider(7, range=0..10))
move = Move(Geometry=polygon.Polygon, Motion=unit_x)  # -> Geometry, Transform
unit_z = UnitZ(Factor=Slider(22, range=0..100))
area = Area(Geometry=move.Geometry)  # -> Area, Centroid
line = Line(StartPoint=construct_point_2, EndPoint=construct_point)
integer_3 = Integer(expr("1", 1))
pi = Pi(Factor=Slider(0.107, range=-0.001..0.2))
construct_point_3 = ConstructPoint(XCoordinate=0, YCoordinate=integer_3, ZCoordinate=0)
construct_point_4 = ConstructPoint(XCoordinate=0, YCoordinate=0, ZCoordinate=0)
rotate_3d = Rotate3D(Geometry=move.Geometry, Angle=expr("-x", pi), Center=area.Centroid, Axis=line)  # -> Geometry, Transform
line_2 = Line(StartPoint=construct_point_4, EndPoint=construct_point_3)
md_slider = MDSlider(SliderMode=0, slider_value=Point(0.5, 0.5, 0.5), x_domain=Domain(0, 1), y_domain=Domain(0, 1), z_domain=Domain(0, 1))
pi_2 = Pi(Factor=Slider(0.541, range=0..1))
boundary_surfaces = BoundarySurfaces(Edges=rotate_3d.Geometry)
pi_3 = Pi(Factor=Slider(1.22, range=0..2))
unit_z_2 = UnitZ(Factor=Slider(22, range=0..100))
evaluate_surface = EvaluateSurface(Surface=boundary_surfaces, Point=md_slider)  # -> Point, Normal, UDirection, VDirection, Frame
construct_domain = ConstructDomain(DomainStart=0, DomainEnd=Slider(2, range=0..2))
unit_z_3 = UnitZ(Factor=number_slider)
multiplication = Multiplication(A=evaluate_surface.Normal, B=number_slider)
range = Range(Domain=construct_domain, Steps=Slider(8, range=0..10))
extrude = Extrude(Base=rotate_3d.Geometry, Direction=multiplication)
construct_domain_2 = ConstructDomain(DomainStart=Slider(0, range=0..100), DomainEnd=Slider(2, range=0..10))
pi_4 = Pi(Factor=range)
cap_holes = CapHoles(Brep=extrude)
range_2 = Range(Domain=construct_domain_2, Steps=integer)
pi_5 = Pi(Factor=range_2)
rotate_3d_2 = Rotate3D(Geometry=cap_holes, Angle=pi_5, Center=Point(0, 0, 0), Axis=Vector(0, 0, 1))  # -> Geometry, Transform
rotate_3d_3 = Rotate3D(Geometry=cap_holes, Angle=pi_5, Center=Point(0, 0, 0), Axis=Vector(0, 0, 1))  # -> Geometry, Transform
construct_domain_3 = ConstructDomain(DomainStart=0, DomainEnd=expr("x-1", integer))
construct_point_5 = ConstructPoint(XCoordinate=0, YCoordinate=0, ZCoordinate=expr("-x", Slider(11, range=0..100)))
construct_point_6 = ConstructPoint(XCoordinate=Slider(13, range=0..100), YCoordinate=0, ZCoordinate=0)
construct_point_7 = ConstructPoint(XCoordinate=0, YCoordinate=number_slider_5, ZCoordinate=expr("-x", number_slider_5))
arc_3pt = Arc3Pt(PointA=construct_point_6, PointB=construct_point_5, PointC=construct_point_7)  # -> Arc, Plane, Radius
curve = Curve(<curve referenced from the Rhino model>)

rotate_3d_4 = Rotate3D(Geometry=cap_holes, Angle=pi_5, Center=Point(0, 0, 0), Axis=Vector(0, 0, 1))  # -> Geometry, Transform
rotate_3d_5 = Rotate3D(Geometry=cap_holes, Angle=pi_5, Center=Point(0, 0, 0), Axis=Vector(0, 0, 1))  # -> Geometry, Transform

sub_list = SubList(List=rotate_3d_4.Geometry, Domain=construct_domain_3, Wrap=True)  # -> List, Index
brep = Brep(sub_list.List)
deconstruct_brep = DeconstructBrep(Brep=brep)  # -> Faces, Edges, Vertices
list_item = ListItem(List=deconstruct_brep.Vertices, Index=Slider(1, range=0..10), Wrap=True)  # -> flatten(Item)
list_item_2 = ListItem(List=deconstruct_brep.Vertices, Index=Slider(1, range=0..10), Wrap=True)  # -> flatten(Item)
list_item_3 = ListItem(List=deconstruct_brep.Vertices, Index=Slider(4, range=0..10), Wrap=True)  # -> flatten(Item)
dispatch = Dispatch(List=list_item_2, DispatchPattern=[True, False])  # -> ListA, ListB
dispatch_2 = Dispatch(List=list_item, DispatchPattern=[True, False])  # -> ListA, ListB
dispatch_3 = Dispatch(List=list_item_3, DispatchPattern=[True, False])  # -> ListA, ListB
dispatch_4 = Dispatch(List=dispatch_2.ListB, DispatchPattern=[True, False])  # -> ListA, ListB
dispatch_5 = Dispatch(List=dispatch_2.ListA, DispatchPattern=[True, False])  # -> ListA, ListB
dispatch_6 = Dispatch(List=dispatch_2.ListB, DispatchPattern=[True, False])  # -> ListA, ListB
dispatch_7 = Dispatch(List=dispatch_2.ListA, DispatchPattern=[True, False])  # -> ListA, ListB
circle_cnr = CircleCNR(Center=dispatch_3.ListA, Normal=Vector(0, 0, 1), Radius=Slider(38, range=0..100))
line_3 = Line(StartPoint=dispatch.ListA, EndPoint=dispatch.ListB)
line_4 = Line(StartPoint=dispatch_5.ListB, EndPoint=dispatch_4.ListA)
line_5 = Line(StartPoint=dispatch_7.ListA, EndPoint=dispatch_6.ListB)
dispatch_8 = Dispatch(List=circle_cnr, DispatchPattern=[True, False])  # -> ListA, ListB
dispatch_9 = Dispatch(List=dispatch_3.ListA, DispatchPattern=[True, False])  # -> ListA, ListB
boundary_surfaces_2 = BoundarySurfaces(Edges=[line_3, line_5, line_4])
area_2 = Area(Geometry=boundary_surfaces_2)  # -> Area, Centroid
point = Point(area_2.Centroid)
construct_domain_4 = ConstructDomain(DomainStart=point, DomainEnd=Slider(-5, range=-7..0))
move_2 = Move(Geometry=area_2.Centroid, Motion=expr("-x", unit_z))  # -> Geometry, Transform
move_3 = Move(Geometry=move_2.Geometry, Motion=unit_x_2)  # -> Geometry, Transform
range_3 = Range(Domain=construct_domain_4, Steps=Slider(72, range=0..100))
cosine = Cosine(Value=range_3)
sine = Sine(Value=range_3)
extrude_2 = Extrude(Base=boundary_surfaces_2, Direction=unit_z_2)
extrude_3 = Extrude(Base=boundary_surfaces_2, Direction=unit_z_2)
multiplication_2 = Multiplication(A=sine, B=number_slider_6)
multiplication_3 = Multiplication(A=cosine, B=number_slider_6)
line_6 = Line(StartPoint=area_2.Centroid, EndPoint=move_3.Geometry)
point_on_curve = PointOnCurve(line_6, parameter=0.702)
move_4 = Move(Geometry=point_on_curve, Motion=unit_x_3)  # -> Geometry, Transform
construct_point_8 = ConstructPoint(XCoordinate=multiplication_2, YCoordinate=multiplication_3, ZCoordinate=range_3)
list_item_4 = ListItem(List=construct_point_8, Index=Slider(54, range=0..100), Wrap=True)
arc_3pt_2 = Arc3Pt(PointA=area_2.Centroid, PointB=move_4.Geometry, PointC=move_3.Geometry)  # -> Arc, Plane, Radius
interpolate = Interpolate(Vertices=construct_point_8, Degree=3, Periodic=False, KnotStyle=1)  # -> Curve, Length, Domain
cone = Cone(Base=list_item_4, Radius=Slider(5, range=0..10), Length=Slider(35, range=0..100))  # -> Cone, Tip
offset_surface = OffsetSurface(Surface=cone.Cone, Distance=1, BothSides=False, CreateSolid=True)
offset_surface_2 = OffsetSurface(Surface=cone.Cone, Distance=1, BothSides=False, CreateSolid=True)
rotate_3d_6 = Rotate3D(Geometry=dispatch_8.ListA, Angle=pi_2, Center=dispatch_9.ListA, Axis=line_2)  # -> Geometry, Transform
perp_frames = PerpFrames(Curve=rotate_3d_6.Geometry, Count=number_slider_3, Align=True)  # -> Frames, Parameters
pipe = Pipe(Curve=interpolate.Curve, Radius=Slider(1.24, range=0..2), Caps=0)
rotate_3d_7 = Rotate3D(Geometry=pipe, Angle=pi_4, Center=Point(0, 0, 0), Axis=Vector(0, 0, 1))  # -> Geometry, Transform
rotate_3d_8 = Rotate3D(Geometry=pipe, Angle=pi_4, Center=Point(0, 0, 0), Axis=Vector(0, 0, 1))  # -> Geometry, Transform
rotate_3d_9 = Rotate3D(Geometry=arc_3pt_2.Arc, Angle=pi_3, Center=move_3.Geometry, Axis=Vector(0, 20.00224754, 0))  # -> Geometry, Transform
area_3 = Area(Geometry=rotate_3d_6.Geometry)  # -> Area, Centroid
ellipse = Ellipse(Plane=perp_frames.Frames, Radius1=Slider(10, range=0..10), Radius2=Slider(7.6, range=0..10))  # -> Ellipse, Focus1, Focus2
divide_curve = DivideCurve(Curve=rotate_3d_6.Geometry, Count=number_slider_3, Kinks=False)  # -> Points, Tangents, Parameters
scale = Scale(Geometry=rotate_3d_9.Geometry, Center=move_3.Geometry, Factor=Slider(1, range=0..1))  # -> Geometry, Transform
line_7 = Line(StartPoint=area_3.Centroid, EndPoint=divide_curve.Points)
merge = Merge(Data1=scale.Geometry, Data2=arc_3pt_2.Arc)
revolution = Revolution(Curve=merge, Axis=Line((0, 0, 0), (0, 0, 44.11065724)), Domain=Domain(0, 6.283185307))
offset_surface_3 = OffsetSurface(Surface=revolution, Distance=number_slider_4, BothSides=False, CreateSolid=True)
offset_surface_4 = OffsetSurface(Surface=revolution, Distance=number_slider_4, BothSides=False, CreateSolid=True)
merge_2 = Merge(Data1=rotate_3d_3.Geometry, Data2=extrude_3, Data3=offset_surface_4, Data4=rotate_3d_8.Geometry, Data5=offset_surface_2)
scale_2 = Scale(Geometry=merge_2, Center=Point(0, 0, 0), Factor=Slider(0.66, range=0..1))  # -> Geometry, Transform
dispatch_10 = Dispatch(List=revolution, DispatchPattern=[True, False])  # -> ListA, ListB
rotate_3d_10 = Rotate3D(Geometry=pipe, Angle=pi_4, Center=Point(0, 0, 0), Axis=Vector(0, 0, 1))  # -> Geometry, Transform

bend_deform = BendDeform(Geometry=rotate_3d_10.Geometry, BendingArc=arc_3pt.Arc)
move_5 = Move(Geometry=scale_2.Geometry, Motion=unit_z_3)  # -> Geometry, Transform
offset_surface_5 = OffsetSurface(Surface=cone.Cone, Distance=1, BothSides=False, CreateSolid=True)
extrude_4 = Extrude(Base=boundary_surfaces_2, Direction=unit_z_2)
offset_surface_6 = OffsetSurface(Surface=revolution, Distance=number_slider_4, BothSides=False, CreateSolid=True)
offset_surface_7 = OffsetSurface(Surface=cone.Cone, Distance=1, BothSides=False, CreateSolid=True)
pipe_2 = Pipe(Curve=line_7, Radius=expr("x/2", number_slider_2), Caps=0)
sphere = Sphere(Base=area_3.Centroid, Radius=number_slider_2)
mirror = Mirror(Geometry=[sphere, pipe_2], Plane=PlaneYZ(0, 0, 0))  # -> Geometry, Transform
offset_surface_8 = OffsetSurface(Surface=revolution, Distance=number_slider_4, BothSides=False, CreateSolid=True)
loft = Loft(Curves=ellipse.Ellipse, Options={Adjust=False, Closed=True, LoftEnds=0, LoftSimp=0, LoftType=0, Rebuild=10, Refit=0.01})
mirror_2 = Mirror(Geometry=loft, Plane=PlaneYZ(0, 0, 0))  # -> Geometry, Transform
extrude_5 = Extrude(Base=boundary_surfaces_2, Direction=unit_z_2)

brep_2 = Brep([mirror.Geometry, sphere, pipe_2, loft, mirror_2.Geometry, rotate_3d_4.Geometry, rotate_3d_5.Geometry, extrude_5, extrude_4, offset_surface_6, offset_surface_8, offset_surface_5, offset_surface_7, move_5.Geometry, bend_deform])
bend_deform_2 = BendDeform(Geometry=brep_2, BendingArc=curve)
