# Grasshopper definition March3rdAirportDuchame002.gh (Grasshopper 1.0.7)
# plug-ins: treesloth01, Pufferfish, Bifocals

# ----
# The World of Duchame
# 
# Airport
# East west Docks
number_slider = Slider(4, range=0..100)
construct_domain = ConstructDomain(DomainStart=number_slider, DomainEnd=Slider(8, range=0..100))
range = Range(Domain=construct_domain, Steps=Slider(7, range=0..100))
sine = Sine(Value=range)
multiplication = Multiplication(A=range, B=Slider(20, range=0..100))
multiplication_2 = Multiplication(A=sine, B=Slider(9, range=0..100))
construct_point = ConstructPoint(XCoordinate=expr("-x", multiplication), YCoordinate=multiplication_2, ZCoordinate=0)
pi = Pi(Factor=Slider(0.64, range=0..1))
pi_2 = Pi(Factor=Slider(0.32, range=0..1))
construct_point_2 = ConstructPoint(XCoordinate=multiplication, YCoordinate=multiplication_2, ZCoordinate=0)
pi_3 = Pi(Factor=Slider(0.339, range=0..1))
pi_4 = Pi(Factor=Slider(0.593, range=0..1))
list_item = ListItem(List=construct_point_2, Index=0, Wrap=True)
list_item_2 = ListItem(List=construct_point, Index=0, Wrap=True)
construct_plane = ConstructPlane(Origin=list_item_2, XAxis=Vector(1, 0, 0), YAxis=Vector(0, 1, 0))
construct_plane_2 = ConstructPlane(Origin=list_item, XAxis=Vector(1, 0, 0), YAxis=Vector(0, 1, 0))
rotate = Rotate(Geometry=construct_point_2, Angle=expr("-x", pi_2), Plane=construct_plane_2)  # -> Geometry, Transform
rotate_2 = Rotate(Geometry=construct_point, Angle=expr("-x", pi_4), Plane=construct_plane)  # -> Geometry, Transform
rotate_3 = Rotate(Geometry=construct_point_2, Angle=pi, Plane=construct_plane_2)  # -> Geometry, Transform
rotate_4 = Rotate(Geometry=construct_point, Angle=pi_3, Plane=construct_plane)  # -> Geometry, Transform

number_slider_2 = Slider(17, range=0..100)
number_slider_3 = Slider(17, range=0..100)
vector_xyz = VectorXYZ(XComponent=number_slider_2, YComponent=number_slider_2, ZComponent=0)  # -> Vector, Length
vector_xyz_2 = VectorXYZ(XComponent=expr("-x", number_slider_2), YComponent=number_slider_2, ZComponent=0)  # -> Vector, Length
vector_xyz_3 = VectorXYZ(XComponent=expr("-x", number_slider_3), YComponent=number_slider_3, ZComponent=0)  # -> Vector, Length
vector_xyz_4 = VectorXYZ(XComponent=number_slider_3, YComponent=number_slider_3, ZComponent=0)  # -> Vector, Length
unit_z = UnitZ(Factor=Slider(12, range=0..100))
unit_z_2 = UnitZ(Factor=Slider(17, range=0..100))
move = Move(Geometry=[rotate_3.Geometry, rotate.Geometry], Motion=vector_xyz.Vector)  # -> Geometry, Transform
move_2 = Move(Geometry=[rotate_3.Geometry, rotate.Geometry], Motion=vector_xyz_2.Vector)  # -> Geometry, Transform
move_3 = Move(Geometry=[rotate_2.Geometry, rotate_4.Geometry], Motion=vector_xyz_3.Vector)  # -> Geometry, Transform
move_4 = Move(Geometry=[rotate_2.Geometry, rotate_4.Geometry], Motion=vector_xyz_4.Vector)  # -> Geometry, Transform
move_5 = Move(Geometry=reverse([rotate_2.Geometry, rotate_4.Geometry]), Motion=unit_z_2)  # -> Geometry, Transform
move_6 = Move(Geometry=[rotate_3.Geometry, rotate.Geometry], Motion=unit_z)  # -> Geometry, Transform
move_7 = Move(Geometry=move.Geometry, Motion=unit_z)  # -> Geometry, Transform
move_8 = Move(Geometry=move_3.Geometry, Motion=unit_z_2)  # -> Geometry, Transform
reverse_list = ReverseList(List=move_5.Geometry)
reverse_list_2 = ReverseList(List=move_5.Geometry)
line = Line(StartPoint=move_7.Geometry, EndPoint=move_6.Geometry)
line_2 = Line(StartPoint=[rotate_3.Geometry, rotate.Geometry], EndPoint=move_6.Geometry)
line_3 = Line(StartPoint=reverse_list_2, EndPoint=move_8.Geometry)
line_4 = Line(StartPoint=[rotate_2.Geometry, rotate_4.Geometry], EndPoint=reverse_list)
line_5 = Line(StartPoint=move_7.Geometry, EndPoint=move.Geometry)
line_6 = Line(StartPoint=move_8.Geometry, EndPoint=move_3.Geometry)
merge = Merge(Data1=line, Data2=line_3)
merge_2 = Merge(Data1=line_5, Data2=line_2, Data3=line_6, Data4=line_4)
perp_frames = PerpFrames(Curve=merge, Count=Slider(2, range=0..10), Align=True)  # -> Frames, Parameters
rectangle = Rectangle(Plane=perp_frames.Frames, XSize=Slider(2, range=0..10), YSize=Slider(9, range=0..10), Radius=0)  # -> Rectangle, Length

number_slider_4 = Slider(1.68, range=0..10)

pipe = Pipe(Curve=merge_2, Radius=number_slider_4, Caps=0)
loft = Loft(
    Curves=rectangle.Rectangle,
    Options={Adjust=False, Closed=False, LoftEnds=0, LoftSimp=0, LoftType=0, Rebuild=10, Refit=0.01})  # -> flatten(Loft)

first_last = FirstLast(List=reverse(loft))  # -> FirstValue, LastValue
md_slider = MDSlider(SliderMode=0, slider_value=Point(0.5, 0.5, 0.5), x_domain=Domain(0, 1), y_domain=Domain(0, 1), z_domain=Domain(0, 1))
brep = Brep(first_last.LastValue)
cap_holes = CapHoles(Brep=brep)
deconstruct_brep = DeconstructBrep(Brep=cap_holes)  # -> Faces, Edges, Vertices
list_item_3 = ListItem(List=deconstruct_brep.Faces, Index=Slider(0, range=0..10), Wrap=True)
evaluate_surface = EvaluateSurface(Surface=list_item_3, Point=md_slider)  # -> Point, Normal, UDirection, VDirection, Frame
multiplication_3 = Multiplication(A=evaluate_surface.Normal, B=Slider(20, range=0..100))
extrude = Extrude(Base=list_item_3, Direction=multiplication_3)
number_slider_5 = Slider(5, range=0..10)
deconstruct_brep_2 = DeconstructBrep(Brep=extrude)  # -> Faces, Edges, Vertices
list_item_4 = ListItem(List=deconstruct_brep_2.Vertices, Index=0, Wrap=True)
pi_5 = Pi(Factor=Slider(0.18, range=0..1))
list_item_5 = ListItem(List=deconstruct_brep_2.Faces, Index=number_slider_5, Wrap=True)
rotate_3d = Rotate3D(Geometry=extrude, Angle=expr("-x", pi_5), Center=list_item_4, Axis=Vector(-196.7361301, 171.4839052, 0))  # -> Geometry, Transform
evaluate_surface_2 = EvaluateSurface(Surface=list_item_5, Point=md_slider)  # -> Point, Normal, UDirection, VDirection, Frame
deconstruct_brep_3 = DeconstructBrep(Brep=rotate_3d.Geometry)  # -> Faces, Edges, Vertices
multiplication_4 = Multiplication(A=evaluate_surface_2.Normal, B=Slider(46, range=0..100))
extrude_2 = Extrude(Base=list_item_5, Direction=multiplication_4)
list_item_6 = ListItem(List=deconstruct_brep_3.Faces, Index=number_slider_5, Wrap=True)
multiplication_5 = Multiplication(A=evaluate_surface_2.Normal, B=Slider(90, range=0..100))
deconstruct_brep_4 = DeconstructBrep(Brep=extrude_2)  # -> Faces, Edges, Vertices
pi_6 = Pi(Factor=Slider(0.08, range=0..1))
extrude_3 = Extrude(Base=list_item_6, Direction=multiplication_5)
list_item_7 = ListItem(List=deconstruct_brep_4.Faces, Index=Slider(2, range=0..10), Wrap=True)
evaluate_surface_3 = EvaluateSurface(Surface=list_item_7, Point=md_slider)  # -> Point, Normal, UDirection, VDirection, Frame
rotate_3d_2 = Rotate3D(Geometry=extrude_3, Angle=expr("-x", pi_6), Center=list_item_4, Axis=Vector(-196.7361301, 171.4839052, 0))  # -> Geometry, Transform
multiplication_6 = Multiplication(A=evaluate_surface_3.Normal, B=Slider(100, range=0..100))
extrude_4 = Extrude(Base=list_item_7, Direction=multiplication_6)
deconstruct_brep_5 = DeconstructBrep(Brep=rotate_3d_2.Geometry)  # -> Faces, Edges, Vertices
construct_domain_2 = ConstructDomain(DomainStart=0, DomainEnd=Slider(141, range=0..200))
number_slider_6 = Slider(5, range=0..100)
list_item_8 = ListItem(List=deconstruct_brep_5.Vertices, Index=Slider(6, range=0..10), Wrap=True)
list_item_9 = ListItem(List=deconstruct_brep_5.Edges, Index=Slider(5, range=0..10), Wrap=True)
deconstruct_brep_6 = DeconstructBrep(Brep=extrude_4)  # -> Faces, Edges, Vertices
range_2 = Range(Domain=construct_domain_2, Steps=Slider(4, range=0..10))
list_item_10 = ListItem(List=deconstruct_brep_6.Faces, Index=Slider(4, range=0..10), Wrap=True)
line_sdl = LineSDL(Start=list_item_8, Direction=list_item_9, Length=expr("-x", Slider(56, range=0..100)))
number_slider_7 = Slider(33, range=0..100)
evaluate_surface_4 = EvaluateSurface(Surface=list_item_10, Point=md_slider)  # -> Point, Normal, UDirection, VDirection, Frame
dispatch = Dispatch(List=deconstruct_brep_6.Vertices, DispatchPattern=[True, False])  # -> ListA, ListB
vector_xyz_5 = VectorXYZ(XComponent=range_2, YComponent=range_2, ZComponent=expr("x/3", range_2))  # -> Vector, Length
multiplication_7 = Multiplication(A=evaluate_surface_4.Normal, B=Slider(53, range=0..100))
vector_xyz_6 = VectorXYZ(XComponent=number_slider_7, YComponent=number_slider_7, ZComponent=0)  # -> Vector, Length
move_9 = Move(Geometry=line_sdl, Motion=vector_xyz_5.Vector)  # -> graft(Geometry), Transform
extrude_5 = Extrude(Base=list_item_10, Direction=multiplication_7)
unit_z_3 = UnitZ(Factor=Slider(12, range=0..100))
move_10 = Move(Geometry=move_9.Geometry, Motion=vector_xyz_6.Vector)  # -> Geometry, Transform
move_11 = Move(Geometry=dispatch.ListB, Motion=unit_z_3)  # -> Geometry, Transform
move_12 = Move(Geometry=extrude_5, Motion=unit_z_3)  # -> Geometry, Transform
param_viewer = ParamViewer(move_9.Geometry)
loft_2 = Loft(
    Curves=[move_9.Geometry, move_10.Geometry],
    Options={Adjust=False, Closed=False, LoftEnds=0, LoftSimp=0, LoftType=0, Rebuild=10, Refit=0.01})
line_7 = Line(StartPoint=dispatch.ListB, EndPoint=move_11.Geometry)
deconstruct_brep_7 = DeconstructBrep(Brep=loft_2)  # -> Faces, Edges, Vertices
unit_z_4 = UnitZ(Factor=Slider(100, range=0..100))

pipe_2 = Pipe(Curve=line_7, Radius=Slider(2.22, range=0..10), Caps=0)

move_13 = Move(Geometry=deconstruct_brep_7.Vertices, Motion=expr("-x", unit_z_4))  # -> Geometry, Transform
extrude_6 = Extrude(Base=loft_2, Direction=multiplication_7)
deconstruct_brep_8 = DeconstructBrep(Brep=move_12.Geometry)  # -> Faces, Edges, Vertices
line_8 = Line(StartPoint=deconstruct_brep_7.Vertices, EndPoint=move_13.Geometry)
list_item_11 = ListItem(List=deconstruct_brep_8.Edges, Index=Slider(0, range=0..100), Wrap=True)
list_item_12 = ListItem(List=deconstruct_brep_8.Edges, Index=Slider(1, range=0..10), Wrap=True)
pipe_3 = Pipe(Curve=line_8, Radius=number_slider_4, Caps=0)
deconstruct_brep_9 = DeconstructBrep(Brep=extrude_6)  # -> Faces, Edges, Vertices
point_on_curve = PointOnCurve(list_item_11, parameter=0.707)
point_on_curve_2 = PointOnCurve(list_item_11, parameter=0.5)
point_on_curve_3 = PointOnCurve(list_item_12, parameter=0.707)
point_on_curve_4 = PointOnCurve(list_item_12, parameter=0.5)
unit_z_5 = UnitZ(Factor=Slider(12, range=0..100))
list_item_13 = ListItem(List=deconstruct_brep_9.Edges, Index=Slider(0, range=0..100), Wrap=True)
list_item_14 = ListItem(List=deconstruct_brep_9.Edges, Index=Slider(1, range=0..10), Wrap=True)
line_9 = Line(StartPoint=point_on_curve_2, EndPoint=point_on_curve)
unit_z_6 = UnitZ(Factor=Slider(34, range=0..100))
line_10 = Line(StartPoint=point_on_curve_4, EndPoint=point_on_curve_3)
unit_z_7 = UnitZ(Factor=Slider(37, range=0..100))
point_on_curve_5 = PointOnCurve(list_item_13, parameter=0.707)
point_on_curve_6 = PointOnCurve(list_item_13, parameter=0.5)
move_14 = Move(Geometry=line_10, Motion=unit_z_5)  # -> Geometry, Transform
point_on_curve_7 = PointOnCurve(list_item_14, parameter=0.707)
point_on_curve_8 = PointOnCurve(list_item_14, parameter=0.5)
unit_z_8 = UnitZ(Factor=Slider(12, range=0..100))
move_15 = Move(Geometry=line_9, Motion=unit_z_6)  # -> Geometry, Transform
move_16 = Move(Geometry=line_10, Motion=unit_z_7)  # -> Geometry, Transform
line_11 = Line(StartPoint=point_on_curve_6, EndPoint=point_on_curve_5)
unit_z_9 = UnitZ(Factor=Slider(37, range=0..100))
line_12 = Line(StartPoint=point_on_curve_8, EndPoint=point_on_curve_7)
unit_z_10 = UnitZ(Factor=Slider(37, range=0..100))
loft_3 = Loft(
    Curves=[line_9, move_15.Geometry],
    Options={Adjust=False, Closed=False, LoftEnds=0, LoftSimp=0, LoftType=0, Rebuild=10, Refit=0.01})
move_17 = Move(Geometry=line_12, Motion=unit_z_8)  # -> Geometry, Transform
loft_4 = Loft(
    Curves=[move_14.Geometry, move_16.Geometry],
    Options={Adjust=False, Closed=False, LoftEnds=0, LoftSimp=0, LoftType=0, Rebuild=10, Refit=0.01})
move_18 = Move(Geometry=line_11, Motion=unit_z_9)  # -> Geometry, Transform
move_19 = Move(Geometry=line_12, Motion=unit_z_10)  # -> Geometry, Transform
solid_difference = SolidDifference(BrepsA=deconstruct_brep_8.Faces, BrepsB=[loft_3, loft_4])
loft_5 = Loft(
    Curves=[line_11, move_18.Geometry],
    Options={Adjust=False, Closed=False, LoftEnds=0, LoftSimp=0, LoftType=0, Rebuild=10, Refit=0.01})
loft_6 = Loft(
    Curves=[move_17.Geometry, move_19.Geometry],
    Options={Adjust=False, Closed=False, LoftEnds=0, LoftSimp=0, LoftType=0, Rebuild=10, Refit=0.01})
solid_difference_2 = SolidDifference(BrepsA=deconstruct_brep_9.Faces, BrepsB=[loft_5, loft_6])

offset_surface = OffsetSurface(Surface=solid_difference, Distance=expr("-x", Slider(2.68, range=0..10)), BothSides=False, CreateSolid=True)

offset_surface_2 = OffsetSurface(Surface=solid_difference_2, Distance=expr("-x", Slider(2.68, range=0..10)), BothSides=False, CreateSolid=True)
