# Grasshopper definition March3rdAirportDuchame004.gh (Grasshopper 1.0.7)
# plug-ins: Bifocals

number_slider = Slider(3, range=0..100)

# ----
# The World of Duchame
# 
# Airport
# East west Docks
number_slider_2 = Slider(4, range=0..100)
construct_domain = ConstructDomain(DomainStart=number_slider_2, DomainEnd=Slider(8, range=0..100))
range = Range(Domain=construct_domain, Steps=Slider(7, range=0..100))
sine = Sine(Value=range)
multiplication = Multiplication(A=range, B=Slider(20, range=0..100))
multiplication_2 = Multiplication(A=sine, B=Slider(9, range=0..100))
construct_point = ConstructPoint(XCoordinate=expr("-x", multiplication), YCoordinate=multiplication_2, ZCoordinate=0)
pi = Pi(Factor=Slider(0.64, range=0..1))
pi_2 = Pi(Factor=Slider(0.32, range=0..1))
construct_point_2 = ConstructPoint(XCoordinate=multiplication, YCoordinate=multiplication_2, ZCoordinate=0)
pi_3 = Pi(Factor=Slider(0.339, range=0..1))
pi_4 = Pi(Factor=Slider(0.593, range=0..1))
list_item = ListItem(List=construct_point_2, Index=0, Wrap=True)
list_item_2 = ListItem(List=construct_point, Index=0, Wrap=True)
construct_plane = ConstructPlane(Origin=list_item_2, XAxis=Vector(1, 0, 0), YAxis=Vector(0, 1, 0))
construct_plane_2 = ConstructPlane(Origin=list_item, XAxis=Vector(1, 0, 0), YAxis=Vector(0, 1, 0))
rotate = Rotate(Geometry=construct_point_2, Angle=expr("-x", pi_2), Plane=construct_plane_2)  # -> Geometry, Transform
rotate_2 = Rotate(Geometry=construct_point, Angle=expr("-x", pi_4), Plane=construct_plane)  # -> Geometry, Transform
rotate_3 = Rotate(Geometry=construct_point_2, Angle=pi, Plane=construct_plane_2)  # -> Geometry, Transform
rotate_4 = Rotate(Geometry=construct_point, Angle=pi_3, Plane=construct_plane)  # -> Geometry, Transform

number_slider_3 = Slider(12, range=0..100)
number_slider_4 = Slider(2, range=0..10)
construct_point_3 = ConstructPoint(XCoordinate=expr("-x", number_slider_3), YCoordinate=expr("-x", number_slider), ZCoordinate=number_slider_4)
construct_point_4 = ConstructPoint(XCoordinate=number_slider_3, YCoordinate=number_slider, ZCoordinate=number_slider_4)
line = Line(StartPoint=construct_point_4, EndPoint=construct_point_3)
unit_z = UnitZ(Factor=number_slider_4)
point_on_curve = PointOnCurve(line, parameter=0.5)
number_slider_5 = Slider(0.1, range=0..0.1)
move = Move(Geometry=point_on_curve, Motion=expr("-x", unit_z))  # -> Geometry, Transform
construct_domain_2 = ConstructDomain(DomainStart=number_slider_5, DomainEnd=Slider(1, range=0..1))
arc_3pt = Arc3Pt(PointA=construct_point_4, PointB=move.Geometry, PointC=construct_point_3)  # -> Arc, Plane, Radius
number_slider_6 = Slider(1, range=0..1)
range_2 = Range(Domain=construct_domain_2, Steps=10)
construct_domain_3 = ConstructDomain(DomainStart=Slider(1.96, range=0..10), DomainEnd=number_slider_5)

number_slider_7 = Slider(17, range=0..100)
number_slider_8 = Slider(17, range=0..100)
vector_xyz = VectorXYZ(XComponent=number_slider_7, YComponent=number_slider_7, ZComponent=0)  # -> Vector, Length
vector_xyz_2 = VectorXYZ(XComponent=expr("-x", number_slider_7), YComponent=number_slider_7, ZComponent=0)  # -> Vector, Length
vector_xyz_3 = VectorXYZ(XComponent=expr("-x", number_slider_8), YComponent=number_slider_8, ZComponent=0)  # -> Vector, Length
vector_xyz_4 = VectorXYZ(XComponent=number_slider_8, YComponent=number_slider_8, ZComponent=0)  # -> Vector, Length
unit_z_2 = UnitZ(Factor=Slider(12, range=0..100))
unit_z_3 = UnitZ(Factor=Slider(17, range=0..100))
move_2 = Move(Geometry=[rotate_3.Geometry, rotate.Geometry], Motion=vector_xyz.Vector)  # -> Geometry, Transform
move_3 = Move(Geometry=[rotate_3.Geometry, rotate.Geometry], Motion=vector_xyz_2.Vector)  # -> Geometry, Transform
move_4 = Move(Geometry=[rotate_2.Geometry, rotate_4.Geometry], Motion=vector_xyz_3.Vector)  # -> Geometry, Transform
move_5 = Move(Geometry=[rotate_2.Geometry, rotate_4.Geometry], Motion=vector_xyz_4.Vector)  # -> Geometry, Transform
move_6 = Move(Geometry=reverse([rotate_2.Geometry, rotate_4.Geometry]), Motion=unit_z_3)  # -> Geometry, Transform
move_7 = Move(Geometry=[rotate_3.Geometry, rotate.Geometry], Motion=unit_z_2)  # -> Geometry, Transform
move_8 = Move(Geometry=move_2.Geometry, Motion=unit_z_2)  # -> Geometry, Transform
move_9 = Move(Geometry=move_4.Geometry, Motion=unit_z_3)  # -> Geometry, Transform
reverse_list = ReverseList(List=move_6.Geometry)
reverse_list_2 = ReverseList(List=move_6.Geometry)
line_2 = Line(StartPoint=move_8.Geometry, EndPoint=move_7.Geometry)
line_3 = Line(StartPoint=move_8.Geometry, EndPoint=move_2.Geometry)
line_4 = Line(StartPoint=[rotate_3.Geometry, rotate.Geometry], EndPoint=move_7.Geometry)
line_5 = Line(StartPoint=reverse_list_2, EndPoint=move_9.Geometry)
line_6 = Line(StartPoint=[rotate_2.Geometry, rotate_4.Geometry], EndPoint=reverse_list)
line_7 = Line(StartPoint=move_9.Geometry, EndPoint=move_4.Geometry)
merge = Merge(Data1=line_2, Data2=line_5)
merge_2 = Merge(Data1=line_3, Data2=line_4, Data3=line_7, Data4=line_6)
perp_frames = PerpFrames(Curve=merge, Count=Slider(2, range=0..10), Align=True)  # -> Frames, Parameters
rectangle = Rectangle(Plane=perp_frames.Frames, XSize=Slider(2, range=0..10), YSize=Slider(9, range=0..10), Radius=0)  # -> Rectangle, Length

scale = Scale(Geometry=arc_3pt.Arc, Center=point_on_curve, Factor=range_2)  # -> flatten(Geometry), Transform
construct_point_5 = ConstructPoint(XCoordinate=Slider(1, range=0..1), YCoordinate=0, ZCoordinate=0)
range_3 = Range(Domain=construct_domain_3, Steps=10)
number_slider_9 = Slider(0, range=0..10)
rotate_3d = Rotate3D(Geometry=scale.Geometry, Angle=range_3, Center=point_on_curve, Axis=construct_point_5)  # -> Geometry, Transform
unit_y = UnitY(Factor=1)
move_10 = Move(Geometry=rotate_3d.Geometry, Motion=unit_y)  # -> Geometry, Transform
list_item_3 = ListItem(List=move_10.Geometry, Index=expr("x-1", number_slider_9), Wrap=True)
xz_plane = XZPlane(Origin=Point(0, 0, 0))
mirror = Mirror(Geometry=move_10.Geometry, Plane=xz_plane)  # -> Geometry, Transform
list_item_4 = ListItem(List=mirror.Geometry, Index=expr("x-1", number_slider_9), Wrap=True)
loft = Loft(
    Curves=move_10.Geometry,
    Options={Adjust=False, Closed=False, LoftEnds=0, LoftSimp=0, LoftType=0, Rebuild=10, Refit=0.01})
loft_2 = Loft(
    Curves=[list_item_3, list_item_4],
    Options={Adjust=False, Closed=False, LoftEnds=0, LoftSimp=0, LoftType=0, Rebuild=10, Refit=0.01})
loft_3 = Loft(Curves=mirror.Geometry, Options={Adjust=False, Closed=False, LoftEnds=0, LoftSimp=0, LoftType=0, Rebuild=10, Refit=0.01})
unit_z_4 = UnitZ(Factor=1)
extrude = Extrude(Base=[loft, loft_3, loft_2], Direction=unit_z_4)

loft_4 = Loft(
    Curves=rectangle.Rectangle,
    Options={Adjust=False, Closed=False, LoftEnds=0, LoftSimp=0, LoftType=0, Rebuild=10, Refit=0.01})
pipe = Pipe(Curve=merge_2, Radius=1, Caps=0)

construct_domain_4 = ConstructDomain(DomainStart=0, DomainEnd=Slider(1.53, range=0..10))
range_4 = Range(Domain=construct_domain_4, Steps=Slider(3, range=0..100))
pi_5 = Pi(Factor=Slider(1.9, range=0..10))
polar_array = PolarArray(Geometry=extrude, Plane=construct_plane, Count=10, Angle=pi_5)  # -> Geometry, Transform
construct_domain_5 = ConstructDomain(DomainStart=Slider(0.23, range=0..1), DomainEnd=Slider(0.56, range=0..1))
flip_matrix = FlipMatrix(Data=polar_array.Geometry)
range_5 = Range(Domain=construct_domain_5, Steps=Slider(1, range=0..10))
scale_2 = Scale(Geometry=flip_matrix, Center=Point(0, 0, 0), Factor=range_4)  # -> graft(Geometry), Transform
pi_6 = Pi(Factor=range_5)
param_viewer = ParamViewer(flip_matrix)
rotate_3d_2 = Rotate3D(Geometry=scale_2.Geometry, Angle=pi_6, Center=Point(0, 0, 0), Axis=Vector(0, 0, 1))  # -> Geometry, Transform
unit_z_5 = UnitZ(Factor=Slider(5, range=0..5))
move_11 = Move(Geometry=rotate_3d_2.Geometry, Motion=unit_z_5)  # -> Geometry, Transform
