# Grasshopper definition March4thAirportDuchame001.gh (Grasshopper 1.0.7)
# plug-ins: Bifocals

# ----
# The World of Duchame
# 
# Airport
# East west Docks
number_slider = Slider(4, range=0..100)
construct_domain = ConstructDomain(DomainStart=number_slider, DomainEnd=Slider(8, range=0..100))
range = Range(Domain=construct_domain, Steps=Slider(7, range=0..100))
sine = Sine(Value=range)
multiplication = Multiplication(A=range, B=Slider(20, range=0..100))
multiplication_2 = Multiplication(A=sine, B=Slider(9, range=0..100))
construct_point = ConstructPoint(XCoordinate=expr("-x", multiplication), YCoordinate=multiplication_2, ZCoordinate=0)
pi = Pi(Factor=Slider(0.64, range=0..1))
pi_2 = Pi(Factor=Slider(0.32, range=0..1))
construct_point_2 = ConstructPoint(XCoordinate=multiplication, YCoordinate=multiplication_2, ZCoordinate=0)
pi_3 = Pi(Factor=Slider(0.339, range=0..1))
pi_4 = Pi(Factor=Slider(0.593, range=0..1))
list_item = ListItem(List=construct_point_2, Index=0, Wrap=True)
list_item_2 = ListItem(List=construct_point, Index=0, Wrap=True)
construct_plane = ConstructPlane(Origin=list_item_2, XAxis=Vector(1, 0, 0), YAxis=Vector(0, 1, 0))
construct_plane_2 = ConstructPlane(Origin=list_item, XAxis=Vector(1, 0, 0), YAxis=Vector(0, 1, 0))
rotate = Rotate(Geometry=construct_point_2, Angle=expr("-x", pi_2), Plane=construct_plane_2)  # -> Geometry, Transform
rotate_2 = Rotate(Geometry=construct_point, Angle=expr("-x", pi_4), Plane=construct_plane)  # -> Geometry, Transform
rotate_3 = Rotate(Geometry=construct_point_2, Angle=pi, Plane=construct_plane_2)  # -> Geometry, Transform
rotate_4 = Rotate(Geometry=construct_point, Angle=pi_3, Plane=construct_plane)  # -> Geometry, Transform

number_slider_2 = Slider(17, range=0..100)
number_slider_3 = Slider(17, range=0..100)
vector_xyz = VectorXYZ(XComponent=number_slider_2, YComponent=number_slider_2, ZComponent=0)  # -> Vector, Length
vector_xyz_2 = VectorXYZ(XComponent=expr("-x", number_slider_2), YComponent=number_slider_2, ZComponent=0)  # -> Vector, Length
vector_xyz_3 = VectorXYZ(XComponent=expr("-x", number_slider_3), YComponent=number_slider_3, ZComponent=0)  # -> Vector, Length
vector_xyz_4 = VectorXYZ(XComponent=number_slider_3, YComponent=number_slider_3, ZComponent=0)  # -> Vector, Length
unit_z = UnitZ(Factor=Slider(12, range=0..100))
unit_z_2 = UnitZ(Factor=Slider(17, range=0..100))
move = Move(Geometry=[rotate_3.Geometry, rotate.Geometry], Motion=vector_xyz.Vector)  # -> Geometry, Transform
move_2 = Move(Geometry=[rotate_3.Geometry, rotate.Geometry], Motion=vector_xyz_2.Vector)  # -> Geometry, Transform
move_3 = Move(Geometry=[rotate_2.Geometry, rotate_4.Geometry], Motion=vector_xyz_3.Vector)  # -> Geometry, Transform
move_4 = Move(Geometry=[rotate_2.Geometry, rotate_4.Geometry], Motion=vector_xyz_4.Vector)  # -> Geometry, Transform
move_5 = Move(Geometry=reverse([rotate_2.Geometry, rotate_4.Geometry]), Motion=unit_z_2)  # -> Geometry, Transform
move_6 = Move(Geometry=[rotate_3.Geometry, rotate.Geometry], Motion=unit_z)  # -> Geometry, Transform
move_7 = Move(Geometry=move.Geometry, Motion=unit_z)  # -> Geometry, Transform
move_8 = Move(Geometry=move_3.Geometry, Motion=unit_z_2)  # -> Geometry, Transform
reverse_list = ReverseList(List=move_5.Geometry)
reverse_list_2 = ReverseList(List=move_5.Geometry)
line = Line(StartPoint=move_7.Geometry, EndPoint=move_6.Geometry)
line_2 = Line(StartPoint=move_7.Geometry, EndPoint=move.Geometry)
line_3 = Line(StartPoint=[rotate_3.Geometry, rotate.Geometry], EndPoint=move_6.Geometry)
line_4 = Line(StartPoint=reverse_list_2, EndPoint=move_8.Geometry)
line_5 = Line(StartPoint=[rotate_2.Geometry, rotate_4.Geometry], EndPoint=reverse_list)
line_6 = Line(StartPoint=move_8.Geometry, EndPoint=move_3.Geometry)
merge = Merge(Data1=line, Data2=line_4)
merge_2 = Merge(Data1=line_2, Data2=line_3, Data3=line_6, Data4=line_5)
perp_frames = PerpFrames(Curve=merge, Count=Slider(2, range=0..10), Align=True)  # -> Frames, Parameters
rectangle = Rectangle(Plane=perp_frames.Frames, XSize=Slider(2, range=0..10), YSize=Slider(9, range=0..10), Radius=0)  # -> Rectangle, Length

loft = Loft(
    Curves=rectangle.Rectangle,
    Options={Adjust=False, Closed=False, LoftEnds=0, LoftSimp=0, LoftType=0, Rebuild=10, Refit=0.01})
pipe = Pipe(Curve=merge_2, Radius=1, Caps=0)
