# Grasshopper definition March4thAirportDuchame003.gh (Grasshopper 1.0.7)
# plug-ins: Bifocals

construct_domain = ConstructDomain(DomainStart=Slider(9.297, range=0..100), DomainEnd=1)
number_slider = Slider(300, range=0..300)

number_slider_2 = Slider(20, range=0..100)
construct_domain_2 = ConstructDomain(DomainStart=Slider(2.266, range=0..100), DomainEnd=Slider(1, range=0..1))

range = Range(Domain=construct_domain, Steps=10)
square = Square(Value=range)
multiplication = Multiplication(A=range, B=Slider(13.7, range=0..40))
construct_domain_3 = ConstructDomain(DomainStart=0, DomainEnd=number_slider)
construct_point = ConstructPoint(XCoordinate=square, YCoordinate=0, ZCoordinate=expr("-x", multiplication))
range_2 = Range(Domain=construct_domain_3, Steps=number_slider)
point = Point(construct_point)
interpolate = Interpolate(Vertices=construct_point, Degree=3, Periodic=False, KnotStyle=1)  # -> Curve, Length, Domain

point_on_curve = PointOnCurve(interpolate.Curve, parameter=0.352)

move = Move(Geometry=point, Motion=Vector(0, 0, 10))  # -> Geometry, Transform
sine = Sine(Value=range_2)
cosine = Cosine(Value=range_2)
perp_frames = PerpFrames(Curve=interpolate.Curve, Count=Slider(1, range=0..1), Align=True)  # -> Frames, Parameters
construct_plane = ConstructPlane(Origin=point, XAxis=Vector(1, 0, 0), YAxis=Vector(0, 1, 0))
construct_point_2 = ConstructPoint(XCoordinate=sine, YCoordinate=cosine, ZCoordinate=range_2)
dispatch = Dispatch(List=perp_frames.Frames, DispatchPattern=[True, False])  # -> ListA, ListB
series = Series(Start=0, Step=Slider(5.578, range=0..100), Count=expr("x+1", number_slider_2))
series_2 = Series(Start=0, Step=Slider(0.54, range=0..2), Count=expr("x+1", number_slider_2))
range_3 = Range(Domain=construct_domain_2, Steps=number_slider_2)
interpolate_2 = Interpolate(Vertices=construct_point_2, Degree=3, Periodic=False, KnotStyle=1)  # -> Curve, Length, Domain
scale = Scale(Geometry=interpolate.Curve, Center=point_on_curve, Factor=range_3)  # -> flatten(Geometry), Transform
orient = Orient(Geometry=interpolate_2.Curve, Source=PlaneXY(0, 0, 0), Target=construct_plane)  # -> Geometry, Transform
unit_y = UnitY(Factor=series)
unit_z = UnitZ(Factor=series_2)  # -> expr("x^2", UnitVector)
construct_domain_4 = ConstructDomain(DomainStart=Slider(0, range=0..100), DomainEnd=Slider(2, range=0..10))
move_2 = Move(Geometry=scale.Geometry, Motion=unit_y)  # -> Geometry, Transform
range_4 = Range(Domain=construct_domain_4, Steps=Slider(4, range=0..10))
move_3 = Move(Geometry=move_2.Geometry, Motion=unit_z)  # -> graft(Geometry), Transform
unit_y_2 = UnitY(Factor=Slider(93, range=0..100))
pi = Pi(Factor=range_4)  # -> graft(Output)
point_on_curve_2 = PointOnCurve(move_3.Geometry, parameter=0.5)
extrude = Extrude(Base=move_3.Geometry, Direction=unit_y_2)
perp_frames_2 = PerpFrames(Curve=move_3.Geometry, Count=Slider(2, range=0..10), Align=True)  # -> Frames, Parameters
unit_z_2 = UnitZ(Factor=Slider(3.11, range=0..10))
pi_2 = Pi(Factor=Slider(0.29, range=0..1))
list_item = ListItem(List=perp_frames_2.Frames, Index=Slider(1, range=0..1), Wrap=True)
pipe = Pipe(Curve=orient.Geometry, Radius=Slider(0.6, range=0..10), Caps=0)  # -> flatten(Pipe)
extrude_2 = Extrude(Base=extrude, Direction=unit_z_2)
xz_plane = XZPlane(Origin=Point(0, 0, 0))

rotate = Rotate(Geometry=extrude_2, Angle=expr("-x", pi_2), Plane=list_item)  # -> Geometry, Transform
mirror = Mirror(Geometry=rotate.Geometry, Plane=xz_plane)  # -> Geometry, Transform

rotate_3d = Rotate3D(Geometry=pipe, Angle=pi, Center=point, Axis=Vector(0, 0, 1))  # -> Geometry, Transform
