# Grasshopper definition March6thAniveDuchameCamp.gh (Grasshopper 1.0.7)
# plug-ins: Bifocals

number_slider = Slider(34, range=0..100)
unit_z = UnitZ(Factor=Slider(57, range=0..100))
circle = Circle(Plane=PlaneXY(0, 0, 0), Radius=Slider(266, range=0..300))
circle_2 = Circle(Plane=PlaneXY(0, 0, 0), Radius=Slider(300, range=0..300))
move = Move(Geometry=circle, Motion=unit_z)  # -> Geometry, Transform
area = Area(Geometry=move.Geometry)  # -> Area, Centroid
divide_curve = DivideCurve(Curve=circle_2, Count=number_slider, Kinks=False)  # -> Points, Tangents, Parameters
divide_curve_2 = DivideCurve(Curve=move.Geometry, Count=number_slider, Kinks=False)  # -> Points, Tangents, Parameters
dispatch = Dispatch(List=divide_curve_2.Points, DispatchPattern=[True, False])  # -> ListA, ListB
series = Series(Start=Slider(0, range=0..1), Step=Slider(0.011, range=0..0.1), Count=expr("x/2", number_slider))
vector_2pt = Vector2Pt(PointA=area.Centroid, PointB=dispatch.ListA, Unitize=False)  # -> Vector, Length
vector_2pt_2 = Vector2Pt(PointA=dispatch.ListB, PointB=area.Centroid, Unitize=False)  # -> Vector, Length
jitter = Jitter(List=series, Jitter=1, Seed=Slider(41, range=0..100))  # -> Values, Indices
multiplication = Multiplication(A=vector_2pt.Vector, B=jitter.Values)
multiplication_2 = Multiplication(A=vector_2pt_2.Vector, B=jitter.Values)
move_2 = Move(Geometry=dispatch.ListA, Motion=multiplication)  # -> Geometry, Transform
move_3 = Move(Geometry=dispatch.ListB, Motion=multiplication_2)  # -> Geometry, Transform
weave = Weave(Pattern=[0, 1], Stream0=move_2.Geometry, Stream1=move_3.Geometry, NullGaps=False)  # -> flatten(Weave)
interpolate = Interpolate(Vertices=weave, Degree=3, Periodic=True, KnotStyle=1)  # -> Curve, Length, Domain
loft = Loft(
    Curves=[interpolate.Curve, circle_2],
    Options={Adjust=False, Closed=False, LoftEnds=0, LoftSimp=0, LoftType=0, Rebuild=10, Refit=0.01})
cap_holes = CapHoles(Brep=loft)
