# Grasshopper definition March6thAniveDuchameCamp001.gh (Grasshopper 1.0.7)
# plug-ins: Bifocals

number_slider = Slider(78, range=0..100)
unit_z = UnitZ(Factor=Slider(57, range=0..100))
number_slider_2 = Slider(9, range=0..100)
circle = Circle(Plane=PlaneXY(0, 0, 0), Radius=Slider(266, range=0..300))
circle_2 = Circle(Plane=PlaneXY(0, 0, 0), Radius=Slider(300, range=0..300))
rectangle = Rectangle(Plane=PlaneXY(0, 0, 0), XSize=Slider(12, range=0..100), YSize=Slider(24, range=0..100), Radius=0)  # -> Rectangle, Length
rectangle_2 = Rectangle(Plane=PlaneXY(0, 0, 0), XSize=Slider(23, range=0..100), YSize=Slider(38, range=0..100), Radius=0)  # -> Rectangle, Length
move = Move(Geometry=circle, Motion=unit_z)  # -> Geometry, Transform
rectangular_array = RectangularArray(Geometry=rectangle.Rectangle, Cell=rectangle_2.Rectangle, XCount=number_slider_2, YCount=number_slider_2)  # -> Geometry, Transform
md_slider = MDSlider(
    SliderMode=0,
    slider_value=Point(0.614153642, 0.7209465213, 0.5),
    x_domain=Domain(0, 1),
    y_domain=Domain(0, 1),
    z_domain=Domain(0, 1))
area = Area(Geometry=move.Geometry)  # -> Area, Centroid
divide_curve = DivideCurve(Curve=move.Geometry, Count=number_slider, Kinks=False)  # -> Points, Tangents, Parameters
series = Series(Start=Slider(0, range=0..1), Step=Slider(0.002826, range=0..0.1), Count=expr("x/2", number_slider))
dispatch = Dispatch(List=divide_curve.Points, DispatchPattern=[True, False])  # -> ListA, ListB
jitter = Jitter(List=series, Jitter=1, Seed=Slider(30, range=0..100))  # -> Values, Indices
vector_2pt = Vector2Pt(PointA=area.Centroid, PointB=dispatch.ListA, Unitize=False)  # -> Vector, Length
vector_2pt_2 = Vector2Pt(PointA=dispatch.ListB, PointB=area.Centroid, Unitize=False)  # -> Vector, Length
unit_z_2 = UnitZ(Factor=Slider(15, range=0..100))
multiplication = Multiplication(A=vector_2pt_2.Vector, B=jitter.Values)
multiplication_2 = Multiplication(A=vector_2pt.Vector, B=jitter.Values)
move_2 = Move(Geometry=dispatch.ListA, Motion=multiplication_2)  # -> Geometry, Transform
move_3 = Move(Geometry=dispatch.ListB, Motion=multiplication)  # -> Geometry, Transform
number_slider_3 = Slider(4.45, range=0..10)
weave = Weave(Pattern=[0, 1], Stream0=move_2.Geometry, Stream1=move_3.Geometry, NullGaps=False)  # -> flatten(Weave)
interpolate = Interpolate(Vertices=weave, Degree=3, Periodic=True, KnotStyle=1)  # -> Curve, Length, Domain
unit_y = UnitY(Factor=number_slider_3)
unit_y_2 = UnitY(Factor=number_slider_3)
unit_y_3 = UnitY(Factor=number_slider_3)
unit_y_4 = UnitY(Factor=number_slider_3)
loft = Loft(
    Curves=[interpolate.Curve, circle_2],
    Options={Adjust=False, Closed=False, LoftEnds=0, LoftSimp=0, LoftType=0, Rebuild=10, Refit=0.01})
number_slider_4 = Slider(48, range=0..100)
cap_holes = CapHoles(Brep=loft)
deconstruct_brep = DeconstructBrep(Brep=cap_holes)  # -> Faces, Edges, Vertices
list_item = ListItem(List=deconstruct_brep.Faces, Index=Slider(1, range=0..10), Wrap=True)
surface = Surface(reparameterize(list_item))
evaluate_surface = EvaluateSurface(Surface=surface, Point=md_slider)  # -> Point, Normal, UDirection, VDirection, Frame
orient = Orient(Geometry=rectangular_array.Geometry, Source=evaluate_surface.Point, Target=surface)  # -> Geometry, Transform
extrude = Extrude(Base=orient.Geometry, Direction=unit_z_2)
deconstruct_brep_2 = DeconstructBrep(Brep=extrude)  # -> Faces, Edges, Vertices
list_item_2 = ListItem(List=deconstruct_brep_2.Vertices, Index=Slider(2, range=0..10), Wrap=True)
list_item_3 = ListItem(List=deconstruct_brep_2.Vertices, Index=Slider(3, range=0..10), Wrap=True)
list_item_4 = ListItem(List=deconstruct_brep_2.Vertices, Index=Slider(1, range=0..10), Wrap=True)
list_item_5 = ListItem(List=deconstruct_brep_2.Vertices, Index=Slider(4, range=0..10), Wrap=True)
list_item_6 = ListItem(List=deconstruct_brep_2.Vertices, Index=Slider(5, range=0..10), Wrap=True)
list_item_7 = ListItem(List=deconstruct_brep_2.Vertices, Index=Slider(7, range=0..10), Wrap=True)
list_item_8 = ListItem(List=deconstruct_brep_2.Vertices, Index=Slider(8, range=0..10), Wrap=True)
list_item_9 = ListItem(List=deconstruct_brep_2.Vertices, Index=Slider(6, range=0..10), Wrap=True)
move_4 = Move(Geometry=list_item_9, Motion=expr("-x", unit_y))  # -> Geometry, Transform
move_5 = Move(Geometry=list_item_6, Motion=expr("-x", unit_y_3))  # -> Geometry, Transform
move_6 = Move(Geometry=list_item_7, Motion=unit_y_2)  # -> Geometry, Transform
move_7 = Move(Geometry=list_item_8, Motion=unit_y_4)  # -> Geometry, Transform
vector_2pt_3 = Vector2Pt(PointA=move_5.Geometry, PointB=list_item_5, Unitize=False)  # -> Vector, Length
vector_2pt_4 = Vector2Pt(PointA=move_7.Geometry, PointB=list_item_4, Unitize=False)  # -> Vector, Length
vector_2pt_5 = Vector2Pt(PointA=move_4.Geometry, PointB=list_item_3, Unitize=False)  # -> Vector, Length
vector_2pt_6 = Vector2Pt(PointA=move_6.Geometry, PointB=list_item_2, Unitize=False)  # -> Vector, Length
line_sdl = LineSDL(Start=move_5.Geometry, Direction=vector_2pt_3.Vector, Length=number_slider_4)
line_sdl_2 = LineSDL(Start=move_7.Geometry, Direction=vector_2pt_4.Vector, Length=number_slider_4)
line_sdl_3 = LineSDL(Start=move_4.Geometry, Direction=vector_2pt_5.Vector, Length=number_slider_4)
line_sdl_4 = LineSDL(Start=move_6.Geometry, Direction=vector_2pt_6.Vector, Length=number_slider_4)

loft_2 = Loft(
    Curves=[line_sdl_2, line_sdl_4],
    Options={Adjust=False, Closed=False, LoftEnds=0, LoftSimp=0, LoftType=0, Rebuild=10, Refit=0.01})
loft_3 = Loft(
    Curves=[line_sdl, line_sdl_3],
    Options={Adjust=False, Closed=False, LoftEnds=0, LoftSimp=0, LoftType=0, Rebuild=10, Refit=0.01})
