# Grasshopper definition March6thAniveDuchameCamp002.gh (Grasshopper 1.0.7)
# plug-ins: Bifocals

number_slider = Slider(77, range=1..101)
unit_z = UnitZ(Factor=Slider(57, range=0..100))
number_slider_2 = Slider(9, range=0..100)
circle = Circle(Plane=PlaneXY(0, 0, 0), Radius=Slider(300, range=0..500))
circle_2 = Circle(Plane=PlaneXY(0, 0, 0), Radius=Slider(266, range=0..500))
rectangle = Rectangle(Plane=PlaneXY(0, 0, 0), XSize=Slider(9, range=0..100), YSize=Slider(30, range=0..100), Radius=0)  # -> Rectangle, Length
rectangle_2 = Rectangle(Plane=PlaneXY(0, 0, 0), XSize=Slider(27, range=0..100), YSize=Slider(66, range=0..100), Radius=0)  # -> Rectangle, Length
move = Move(Geometry=circle_2, Motion=unit_z)  # -> Geometry, Transform
unit_x = UnitX(Factor=Slider(11, range=0..100))
rectangular_array = RectangularArray(Geometry=rectangle.Rectangle, Cell=rectangle_2.Rectangle, XCount=number_slider_2, YCount=number_slider_2)  # -> Geometry, Transform
area = Area(Geometry=move.Geometry)  # -> Area, Centroid
divide_curve = DivideCurve(Curve=move.Geometry, Count=number_slider, Kinks=False)  # -> Points, Tangents, Parameters
series = Series(Start=Slider(0, range=0..1), Step=Slider(0.002826, range=0..0.1), Count=expr("x/2", number_slider))
dispatch = Dispatch(List=divide_curve.Points, DispatchPattern=[True, False])  # -> ListA, ListB
jitter = Jitter(List=series, Jitter=1, Seed=Slider(22, range=0..100))  # -> Values, Indices
construct_domain = ConstructDomain(DomainStart=Slider(0, range=0..100), DomainEnd=Slider(35, range=0..100))
vector_2pt = Vector2Pt(PointA=area.Centroid, PointB=dispatch.ListA, Unitize=False)  # -> Vector, Length
vector_2pt_2 = Vector2Pt(PointA=dispatch.ListB, PointB=area.Centroid, Unitize=False)  # -> Vector, Length
range = Range(Domain=construct_domain, Steps=Slider(48, range=0..100))
multiplication = Multiplication(A=vector_2pt_2.Vector, B=jitter.Values)
multiplication_2 = Multiplication(A=vector_2pt.Vector, B=jitter.Values)
unit_z_2 = UnitZ(Factor=Slider(5, range=0..100))
sine = Sine(Value=range)
cosine = Cosine(Value=range)
move_2 = Move(Geometry=dispatch.ListA, Motion=multiplication_2)  # -> Geometry, Transform
move_3 = Move(Geometry=dispatch.ListB, Motion=multiplication)  # -> Geometry, Transform
number_slider_3 = Slider(4.45, range=0..10)
construct_point = ConstructPoint(XCoordinate=range, YCoordinate=sine, ZCoordinate=cosine)
weave = Weave(Pattern=[0, 1], Stream0=move_2.Geometry, Stream1=move_3.Geometry, NullGaps=False)  # -> flatten(Weave)
interpolate = Interpolate(Vertices=weave, Degree=3, Periodic=True, KnotStyle=1)  # -> Curve, Length, Domain
interpolate_2 = Interpolate(Vertices=construct_point, Degree=3, Periodic=False, KnotStyle=1)  # -> Curve, Length, Domain
series_2 = Series(Start=0, Step=1, Count=Slider(7, range=0..10))
unit_y = UnitY(Factor=number_slider_3)
unit_y_2 = UnitY(Factor=number_slider_3)
unit_y_3 = UnitY(Factor=number_slider_3)
unit_y_4 = UnitY(Factor=number_slider_3)
loft = Loft(
    Curves=[interpolate.Curve, circle],
    Options={Adjust=False, Closed=False, LoftEnds=0, LoftSimp=0, LoftType=0, Rebuild=10, Refit=0.01})
number_slider_4 = Slider(11, range=0..100)
pipe = Pipe(Curve=interpolate_2.Curve, Radius=Slider(0.159, range=0..1), Caps=1)
yz_plane = YZPlane(Origin=Point(0, 0, 0))
cap_holes = CapHoles(Brep=loft)
deconstruct_brep = DeconstructBrep(Brep=cap_holes)  # -> Faces, Edges, Vertices
list_item = ListItem(List=deconstruct_brep.Faces, Index=Slider(6, range=0..10), Wrap=True)
surface = Surface(reparameterize(list_item))
area_2 = Area(Geometry=surface)  # -> Area, Centroid
orient = Orient(Geometry=rectangular_array.Geometry, Source=PlaneXY(0, 0, 0), Target=surface)  # -> Geometry, Transform
scale = Scale(Geometry=orient.Geometry, Center=area_2.Centroid, Factor=0.5)  # -> Geometry, Transform
extrude = Extrude(Base=scale.Geometry, Direction=unit_z_2)
deconstruct_brep_2 = DeconstructBrep(Brep=extrude)  # -> Faces, Edges, Vertices
list_item_2 = ListItem(List=deconstruct_brep_2.Vertices, Index=Slider(2, range=0..10), Wrap=True)
list_item_3 = ListItem(List=deconstruct_brep_2.Vertices, Index=Slider(3, range=0..10), Wrap=True)
list_item_4 = ListItem(List=deconstruct_brep_2.Vertices, Index=Slider(1, range=0..10), Wrap=True)
list_item_5 = ListItem(List=deconstruct_brep_2.Vertices, Index=Slider(4, range=0..10), Wrap=True)
list_item_6 = ListItem(List=deconstruct_brep_2.Vertices, Index=Slider(5, range=0..10), Wrap=True)
list_item_7 = ListItem(List=deconstruct_brep_2.Vertices, Index=Slider(7, range=0..10), Wrap=True)
list_item_8 = ListItem(List=deconstruct_brep_2.Vertices, Index=Slider(8, range=0..10), Wrap=True)
line = Line(StartPoint=list_item_6, EndPoint=list_item_8)
point_on_curve = PointOnCurve(line, parameter=0.5)
move_4 = Move(Geometry=point_on_curve, Motion=unit_x)  # -> Geometry, Transform
list_item_9 = ListItem(List=deconstruct_brep_2.Vertices, Index=Slider(6, range=0..10), Wrap=True)
move_5 = Move(Geometry=list_item_9, Motion=expr("-x", unit_y))  # -> Geometry, Transform
move_6 = Move(Geometry=list_item_6, Motion=expr("-x", unit_y_3))  # -> Geometry, Transform
move_7 = Move(Geometry=list_item_7, Motion=unit_y_2)  # -> Geometry, Transform
move_8 = Move(Geometry=list_item_8, Motion=unit_y_4)  # -> Geometry, Transform
number_slider_5 = Slider(0.23, range=0..1)
rotate = Rotate(Geometry=pipe, Angle=series_2, Plane=yz_plane)  # -> Geometry, Transform
vector_2pt_3 = Vector2Pt(PointA=move_8.Geometry, PointB=list_item_4, Unitize=False)  # -> Vector, Length
vector_2pt_4 = Vector2Pt(PointA=move_5.Geometry, PointB=list_item_3, Unitize=False)  # -> Vector, Length
vector_2pt_5 = Vector2Pt(PointA=move_7.Geometry, PointB=list_item_2, Unitize=False)  # -> Vector, Length
vector_2pt_6 = Vector2Pt(PointA=move_6.Geometry, PointB=list_item_5, Unitize=False)  # -> Vector, Length
line_sdl = LineSDL(Start=move_7.Geometry, Direction=vector_2pt_5.Vector, Length=number_slider_4)
line_sdl_2 = LineSDL(Start=move_6.Geometry, Direction=vector_2pt_6.Vector, Length=number_slider_4)
line_sdl_3 = LineSDL(Start=move_5.Geometry, Direction=vector_2pt_4.Vector, Length=number_slider_4)
line_sdl_4 = LineSDL(Start=move_8.Geometry, Direction=vector_2pt_3.Vector, Length=number_slider_4)
line_line = LineLine(Line1=line_sdl_2, Line2=line_sdl_4)  # -> flatten(ParamA), ParamB, PointA, PointB
point = Point(line_line.PointA)
vector_2pt_7 = Vector2Pt(PointA=point, PointB=move_4.Geometry, Unitize=False)  # -> Vector, Length
xy_plane = XYPlane(Origin=point)
deconstruct_plane = DeconstructPlane(Plane=xy_plane)  # -> Origin, XAxis, YAxis, ZAxis
orient_2 = Orient(Geometry=rotate.Geometry, Source=PlaneXY(0, 0, 0), Target=xy_plane)  # -> Geometry, Transform
scale_nu = ScaleNU(Geometry=orient_2.Geometry, Plane=xy_plane, ScaleX=Slider(1, range=0..1), ScaleY=number_slider_5, ScaleZ=number_slider_5)  # -> Geometry, Transform
pi = Pi(Factor=Slider(0.099, range=0..1))
rotate_2 = Rotate(Geometry=scale_nu.Geometry, Angle=pi, Plane=xy_plane)  # -> Geometry, Transform
xz_plane = XZPlane(Origin=Point(0, 0, 0))
pi_2 = Pi(Factor=Slider(0.093, range=0..1))

loft_2 = Loft(
    Curves=[line_sdl_2, line_sdl_3],
    Options={Adjust=False, Closed=False, LoftEnds=0, LoftSimp=0, LoftType=0, Rebuild=10, Refit=0.01})
loft_3 = Loft(
    Curves=[line_sdl_4, line_sdl],
    Options={Adjust=False, Closed=False, LoftEnds=0, LoftSimp=0, LoftType=0, Rebuild=10, Refit=0.01})

rotate_3d = Rotate3D(Geometry=rotate_2.Geometry, Angle=expr("-x", pi_2), Center=deconstruct_plane.Origin, Axis=xz_plane)  # -> Geometry, Transform
