# Grasshopper definition March6thAugsamDuchamePit.gh (Grasshopper 1.0.7)
# plug-ins: Bifocals

number_slider = Slider(27, range=0..100)
md_slider = MDSlider(
    SliderMode=0,
    slider_value=Point(0.602439043, 0.5634145969, 0.5),
    x_domain=Domain(0, 1),
    y_domain=Domain(0, 1),
    z_domain=Domain(0, 1))
number_slider_2 = Slider(10, range=0..100)
number_slider_3 = Slider(4, range=0..100)
unit_z = UnitZ(Factor=Slider(88, range=0..100))
plane_surface = PlaneSurface(Plane=PlaneXY(0, 0, 0), XSize=Domain(-100, 100), YSize=Domain(-100, 100))
construct_domain = ConstructDomain(DomainStart=Slider(18, range=0..100), DomainEnd=number_slider_2)
construct_point = ConstructPoint(XCoordinate=Slider(0.52, range=0..1), YCoordinate=Slider(0.46, range=0..1), ZCoordinate=0)
surface_frames = SurfaceFrames(UCount=10, VCount=10)  # -> flatten(Frames), Parameters
yz_plane = YZPlane(Origin=Point(0, 0, 0))
extrude = Extrude(Base=plane_surface, Direction=unit_z)
divide_surface = DivideSurface(Surface=plane_surface, UCount=number_slider, VCount=number_slider)  # -> flatten(Points), Normals, Parameters
evaluate_surface = EvaluateSurface(Surface=reparameterize(plane_surface), Point=construct_point)  # -> Point, Normal, UDirection, VDirection, Frame
range = Range(Domain=construct_domain, Steps=Slider(10, range=0..10))
vector_xyz = VectorXYZ(
    XComponent=expr("-x", number_slider_3),
    YComponent=expr("-x*2", number_slider_3),
    ZComponent=expr("2*x", number_slider_3))  # -> Vector, Length
ellipse = Ellipse(Plane=yz_plane, Radius1=Slider(2, range=0..10), Radius2=Slider(6.08, range=0..10))  # -> Ellipse, Focus1, Focus2
distance = Distance(PointA=divide_surface.Points, PointB=evaluate_surface.Point)
series = Series(Start=Slider(0.49, range=0..1), Step=Slider(0.04, range=-0.01..0.1), Count=10)
series_2 = Series(Start=number_slider_2, Step=1, Count=10)
remap = Remap(data=distance, min=0, max=1)
jitter = Jitter(List=series, Jitter=1, Seed=Slider(12, range=0..100))  # -> Values, Indices
jitter_2 = Jitter(List=series, Jitter=1, Seed=Slider(36, range=0..100))  # -> Values, Indices
jitter_3 = Jitter(List=series_2, Jitter=1, Seed=2)  # -> Values, Indices
series_3 = Series(Start=Slider(5.12, range=0..10), Step=Slider(0.608, range=0..1), Count=10)
graph_mapper = GraphMapper(
    remap,
    x0=0,
    x1=1,
    y0=0,
    y1=1,
    container_name="Bezier",
    cpx=[0, 0.3297710717, 0.03053435124, 1],
    cpy=[0.1273238659, 0.5788732171, 1, 1])
scale_nu = ScaleNU(Geometry=ellipse.Ellipse, Plane=yz_plane, ScaleX=jitter.Values, ScaleY=jitter_2.Values, ScaleZ=1)  # -> Geometry, Transform
unit_z_2 = UnitZ(Factor=jitter_3.Values)
jitter_4 = Jitter(List=series_3, Jitter=1, Seed=Slider(12, range=0..100))  # -> Values, Indices
graph_mapper_2 = GraphMapper(
    graph_mapper,
    x0=0,
    x1=1,
    y0=0,
    y1=1,
    container_name="Sine",
    Equation_px=[0.2974683642, 1],
    Equation_py=[0.1699998975, 0.9376811385])
series_4 = Series(Start=Slider(0, range=0..1), Step=Slider(0.19, range=0..1), Count=10)
move = Move(Geometry=scale_nu.Geometry, Motion=unit_z_2)  # -> Geometry, Transform
remap_2 = Remap(data=graph_mapper_2, min=Slider(0, range=0..100), max=Slider(35, range=0..100))
jitter_5 = Jitter(List=series_4, Jitter=1, Seed=2)  # -> Values, Indices
series_5 = Series(Start=Slider(0.26, range=0..1), Step=Slider(0.13, range=0..1), Count=10)
series_6 = Series(Start=Slider(0.37, range=0..1), Step=Slider(0.17, range=0..1), Count=10)
area = Area(Geometry=move.Geometry)  # -> Area, Centroid
unit_z_3 = UnitZ(Factor=remap_2)
pi = Pi(Factor=jitter_5.Values)
move_2 = Move(Geometry=divide_surface.Points, Motion=unit_z_3)  # -> Geometry, Transform
jitter_6 = Jitter(List=series_5, Jitter=1, Seed=Slider(12, range=0..100))  # -> Values, Indices
rotate_3d = Rotate3D(Geometry=move.Geometry, Angle=pi, Center=area.Centroid, Axis=Vector(0, 0, 1))  # -> Geometry, Transform
md_slider_2 = MDSlider(SliderMode=0, slider_value=Point(0.5, 0.5, 0.5), x_domain=Domain(0, 1), y_domain=Domain(0, 1), z_domain=Domain(0, 1))
surface_from_points = SurfaceFromPoints(Points=move_2.Geometry, UCount=expr("x+1", number_slider), Interpolate=False)
brep_edges = BrepEdges()  # -> graft(Naked), Interior, NonManifold
brep_edges_2 = BrepEdges()  # -> graft(Naked), Interior, NonManifold
boundary_surfaces = BoundarySurfaces(Edges=rotate_3d.Geometry)
split_brep = SplitBrep(Brep=extrude, Cutter=surface_from_points)
evaluate_surface_2 = EvaluateSurface(Surface=reparameterize(boundary_surfaces), Point=md_slider_2)  # -> Point, Normal, UDirection, VDirection, Frame
loft = Loft(
    Curves=[brep_edges_2.Naked, brep_edges.Naked],
    Options={Adjust=False, Closed=False, LoftEnds=0, LoftSimp=0, LoftType=0, Rebuild=10, Refit=0.01})
series_7 = Series(Start=Slider(67, range=0..100), Step=Slider(2, range=0..10), Count=10)
dispatch = Dispatch(List=split_brep, DispatchPattern=[True, False])  # -> ListA, ListB
jitter_7 = Jitter(List=series_7, Jitter=1, Seed=Slider(19, range=0..100))  # -> Values, Indices
multiplication = Multiplication(A=evaluate_surface_2.Normal, B=jitter_7.Values)
brep = Brep(dispatch.ListA)
extrude_2 = Extrude(Base=boundary_surfaces, Direction=multiplication)
deconstruct_brep = DeconstructBrep(Brep=extrude_2)  # -> Faces, Edges, Vertices
list_item = ListItem(List=deconstruct_brep.Faces, Index=Slider(2, range=0..10), Wrap=True)
area_2 = Area(Geometry=list_item)  # -> Area, Centroid
construct_plane = ConstructPlane(Origin=area_2.Centroid, XAxis=Vector(1, 0, 0), YAxis=Vector(0, 1, 0))  # -> flatten(Plane)
sphere = Sphere(Base=construct_plane, Radius=jitter_4.Values)
scale_nu_2 = ScaleNU(Geometry=sphere, Plane=construct_plane, ScaleX=series_6, ScaleY=jitter_6.Values, ScaleZ=Slider(0.59, range=0..1))  # -> Geometry, Transform
brep_join = BrepJoin(Breps=[brep, surface_from_points])  # -> flatten(Breps), Closed
solid_union = SolidUnion(Breps=brep_join.Breps)
solid_difference = SolidDifference(BrepsA=solid_union, BrepsB=extrude_2)

brep_2 = Brep(scale_nu_2.Geometry)
solid_difference_2 = SolidDifference(BrepsA=solid_difference, BrepsB=brep_2)

height = Slider(10, range=-1..10)
planesrf = PlaneSurface(Plane=PlaneXY(0, 0, 0), XSize=Slider(11, range=0..100), YSize=Slider(14, range=0..100))

move_3 = Move(Geometry=planesrf, Motion=vector_xyz.Vector)  # -> Geometry, Transform

pop2d = Populate2D(Region=move_3.Geometry, Count=Slider(398, range=0..1100), Seed=1)
del = DelaunayMesh(Points=pop2d, Plane=PlaneXY(0, 0, 0))
demesh = DeconstructMesh(Mesh=del)  # -> Vertices, Faces, Colours, Normals
lng = ListLength(List=demesh.Vertices)
pdecon = Deconstruct(Point=demesh.Vertices)  # -> XComponent, YComponent, ZComponent
random = Random(Range=Domain(0, 1), Number=lng, Seed=2)
multiplication_2 = Multiplication(A=random, B=height)
pt = ConstructPoint(XCoordinate=pdecon.XComponent, YCoordinate=pdecon.YComponent, ZCoordinate=multiplication_2)
conmesh = ConstructMesh(Vertices=pt, Faces=demesh.Faces)

# ==== cluster Remap: Remaps numbers
data = ClusterInput()
min = ClusterInput()
max = ClusterInput()
bnd = Bounds(Numbers=data)
dom = ConstructDomain(DomainStart=min, DomainEnd=max)
remap = RemapNumbers(Value=data, Source=bnd, Target=dom)  # -> Mapped, Clipped
R = ClusterOutput(remap.Mapped)
