# Grasshopper definition March9thLiftingPullingWSII001.gh (Grasshopper 1.0.7)
# plug-ins: Bifocals

number_slider = Slider(12.564, range=0..100)
number_slider_2 = Slider(0.4, range=0..10)
construct_domain = ConstructDomain(DomainStart=0, DomainEnd=number_slider)
range = Range(Domain=construct_domain, Steps=Slider(21, range=0..100))
cosine = Cosine(Value=range)
sine = Sine(Value=range)
multiplication = Multiplication(A=sine, B=number_slider_2)
multiplication_2 = Multiplication(A=cosine, B=number_slider_2)
series = Series(Start=0, Step=Slider(0.5, range=0..1), Count=Slider(4, range=0..10))
construct_point = ConstructPoint(XCoordinate=range, YCoordinate=0, ZCoordinate=0)
construct_point_2 = ConstructPoint(XCoordinate=range, YCoordinate=expr("-x", multiplication), ZCoordinate=expr("-x", multiplication_2))
yz_plane = YZPlane(Origin=Point(0, 0, 0))
pi = Pi(Factor=series)
interpolate = Interpolate(Vertices=construct_point, Degree=3, Periodic=False, KnotStyle=1)  # -> Curve, Length, Domain
interpolate_2 = Interpolate(Vertices=construct_point_2, Degree=3, Periodic=False, KnotStyle=1)  # -> Curve, Length, Domain
xz_plane = XZPlane(Origin=Point(0, 0, 0))
pipe = Pipe(Curve=interpolate_2.Curve, Radius=Slider(0.13, range=0..1), Caps=2)
arc = Arc(Plane=xz_plane, Radius=Slider(6, range=0..100), Angle=Domain(0, 3.141592654))  # -> Arc, Length
rotate_3d = Rotate3D(Geometry=pipe, Angle=pi, Center=Point(0, 0, 0), Axis=yz_plane)  # -> Geometry, Transform
evaluate_curve = EvaluateCurve(Curve=reparameterize(arc.Arc), Parameter=Slider(0, range=0..1))  # -> Point, Tangent, Angle
evaluate_curve_2 = EvaluateCurve(Curve=reparameterize(arc.Arc), Parameter=Slider(1, range=0..1))  # -> Point, Tangent, Angle
flow = Flow(
    Geometry=rotate_3d.Geometry,
    Base=interpolate.Curve,
    Target=arc.Arc,
    ReverseBase=False,
    ReverseTarget=False,
    Stretch=True,
    Rigid=False)
xy_plane = XYPlane(Origin=evaluate_curve.Point)
xy_plane_2 = XYPlane(Origin=evaluate_curve_2.Point)
orient = Orient(Geometry=[rotate_3d.Geometry, interpolate.Curve], Source=yz_plane, Target=xy_plane)  # -> Geometry, Transform
orient_2 = Orient(Geometry=rotate_3d.Geometry, Source=yz_plane, Target=xy_plane_2)  # -> Geometry, Transform
unit_z = UnitZ(Factor=number_slider)
orient_3 = Orient(Geometry=interpolate.Curve, Source=yz_plane, Target=xy_plane)  # -> Geometry, Transform
mirror = Mirror(Geometry=orient_3.Geometry, Plane=xy_plane)  # -> Geometry, Transform
number_slider_3 = Slider(4, range=0..10)
move = Move(Geometry=orient.Geometry, Motion=expr("-x", unit_z))  # -> Geometry, Transform
move_2 = Move(Geometry=orient_2.Geometry, Motion=expr("-x", unit_z))  # -> Geometry, Transform
unit_z_2 = UnitZ(Factor=number_slider)
unit_z_3 = UnitZ(Factor=number_slider)
linear_array = LinearArray(Geometry=mirror.Geometry, Direction=expr("-x", unit_z_3), Count=number_slider_3)  # -> Geometry, Transform
list_item = ListItem(List=linear_array.Geometry, Index=Slider(1, range=0..10), Wrap=True)
point_on_curve = PointOnCurve(list_item, parameter=0.957)
construct_plane = ConstructPlane(Origin=point_on_curve, XAxis=Vector(1, 0, 0), YAxis=Vector(0, 1, 0))

linear_array_2 = LinearArray(Geometry=move_2.Geometry, Direction=expr("-x", unit_z_2), Count=number_slider_3)  # -> Geometry, Transform
linear_array_3 = LinearArray(Geometry=move.Geometry, Direction=expr("-x", unit_z_3), Count=number_slider_3)  # -> Geometry, Transform

mirror_2 = Mirror(Geometry=flow, Plane=construct_plane)  # -> Geometry, Transform
