# Grasshopper definition MyFirstPyNode.gh (Grasshopper 1.0.7)

panel = Panel("433143d0-bd45-427b-bc00-0f08915fece9")
number_slider = Slider(5, range=0..10)
unit_x = UnitX(Factor=1)
ghpython_script = GhPythonScript(x=unit_x)  # -> out, a
# ---------- ghpython_script: Python ----------
__author__ = "mwickerson"
__version__ = "2019.10.15"

import rhinoscriptsyntax as rs
for input in ghenv.Component.Params.Input:
    for source in input.Sources:
        a = str(source.InstanceGuid)
# ---------- end ghpython_script ----------
panel_2 = Panel(ghpython_script.a)
