# Grasshopper definition October17th2019GUID.gh (Grasshopper 1.0.7)
# plug-ins: Bifocals

number_slider = Slider(9, range=1..180)
polygon = Polygon(Plane=PlaneXY(0, 0, 0), Radius=Slider(12, range=0..100), Segments=Slider(10, range=3..10), FilletRadius=0)  # -> Polygon, Length
unit_z = UnitZ(Factor=number_slider)
number_slider_2 = Slider(100, range=0..100)
move = Move(Geometry=polygon.Polygon, Motion=unit_z)  # -> Geometry, Transform
loft = Loft(
    Curves=[polygon.Polygon, move.Geometry],
    Options={Adjust=False, Closed=False, LoftEnds=0, LoftSimp=0, LoftType=0, Rebuild=10, Refit=0.01})
rotate = Rotate(Geometry=loft, Angle=degrees(number_slider), Plane=PlaneXY(0, 0, 0))  # -> Geometry, Transform
unit_x = UnitX(Factor=number_slider_2)
unit_y = UnitY(Factor=number_slider_2)
move_2 = Move(Geometry=rotate.Geometry, Motion=unit_x)  # -> Geometry, Transform
number_slider_3 = Slider(12, range=-1..12)
move_3 = Move(Geometry=move_2.Geometry, Motion=unit_y)  # -> Geometry, Transform
ghpython_script = GhPythonScript(x=number_slider_3)  # -> out, a
# ---------- ghpython_script: Python ----------
__author__ = "mwickerson"
__version__ = "2019.10.15"

import rhinoscriptsyntax as rs
for input in ghenv.Component.Params.Input:
    for source in input.Sources:
        a = str(source.InstanceGuid)
# ---------- end ghpython_script ----------
rotate_2 = Rotate(Geometry=move_3.Geometry, Angle=expr("x*15", number_slider_3), Plane=PlaneXY(0, 0, 0))  # -> Geometry, Transform
panel = Panel(ghpython_script.a)
cap_holes = CapHoles(Brep=rotate_2.Geometry)
