# Grasshopper definition PythonNode001.gh (Grasshopper 1.0.7)
# plug-ins: Bifocals

number_slider = Slider(10, range=0..10)
pt = ConstructPoint(XCoordinate=Slider(120, range=0..1000), YCoordinate=Slider(120, range=0..1000), ZCoordinate=Slider(120, range=0..1000))
rectangle = Rectangle(Plane=PlaneXY(0, 0, 0), XSize=number_slider, YSize=number_slider, Radius=0)  # -> Rectangle, Length
Z = UnitZ(Factor=number_slider)
move = Move(Geometry=rectangle.Rectangle, Motion=Z)  # -> Geometry, Transform
area = Area(Geometry=move.Geometry)  # -> Area, Centroid
rad = Radians(Degrees=expr("x*10", Slider(5, range=0..10)))
scale = Scale(Geometry=move.Geometry, Center=area.Centroid, Factor=expr("x/10", Slider(7, range=0..10)))  # -> Geometry, Transform
scale_2 = Scale(Geometry=scale.Geometry, Center=area.Centroid, Factor=rad)  # -> Geometry, Transform
rotate = Rotate(Geometry=scale_2.Geometry, Angle=rad, Plane=area.Centroid)  # -> Geometry, Transform
loft = Loft(
    Curves=[rotate.Geometry, rectangle.Rectangle],
    Options={Adjust=False, Closed=False, LoftEnds=0, LoftSimp=0, LoftType=0, Rebuild=10, Refit=0.01})
cap = CapHoles(Brep=loft)
python = GhPythonScript(X=pt)  # -> Out, A
panel = Panel(python.Out)
panel_2 = Panel(python.A)
