# Grasshopper definition PythonNode002GUID.gh (Grasshopper 1.0.7)
# plug-ins: Bifocals

number_slider = Slider(7, range=0..10)
scale_nu = ScaleNU(Plane=PlaneXY(0, 0, 0), ScaleX=1, ScaleY=1, ScaleZ=1)  # -> Geometry, Transform
number_slider_2 = Slider(10, range=0..10)

panel = Panel("07296706-e3d3-409a-840c-bd693e880512")
# Get GUID from Rhino
number_slider_3 = Slider(2, range=0..10)
X = UnitX(Factor=1)

pt = ConstructPoint(XCoordinate=Slider(120, range=0..1000), YCoordinate=Slider(120, range=0..1000), ZCoordinate=Slider(120, range=0..1000))
rectangle = Rectangle(Plane=PlaneXY(0, 0, 0), XSize=number_slider_2, YSize=number_slider_2, Radius=0)  # -> Rectangle, Length
Z = UnitZ(Factor=number_slider_2)
python = GhPythonScript(x=number_slider)  # -> out, a
# ---------- python: Python ----------
__author__ = "mwickerson"
__version__ = "2019.06.12"

import rhinoscriptsyntax as rs

for input in ghenv.Component.Params.Input:
    for source in input.Sources:
        a = str (source.InstanceGuid)
# ---------- end python ----------
move = Move(Geometry=rectangle.Rectangle, Motion=Z)  # -> Geometry, Transform
area = Area(Geometry=move.Geometry)  # -> Area, Centroid
# rt click- copy data only - editor
panel_2 = Panel(python.a)
rad = Radians(Degrees=expr("x*10", Slider(5, range=0..10)))
scale = Scale(Geometry=move.Geometry, Center=area.Centroid, Factor=expr("x/10", number_slider))  # -> Geometry, Transform
scale_2 = Scale(Geometry=scale.Geometry, Center=area.Centroid, Factor=rad)  # -> Geometry, Transform
rotate = Rotate(Geometry=scale_2.Geometry, Angle=rad, Plane=area.Centroid)  # -> Geometry, Transform
loft = Loft(
    Curves=[rotate.Geometry, rectangle.Rectangle],
    Options={Adjust=False, Closed=False, LoftEnds=0, LoftSimp=0, LoftType=0, Rebuild=10, Refit=0.01})
cap = CapHoles(Brep=loft)
python_2 = GhPythonScript(X=pt)  # -> Out, A
panel_3 = Panel(python_2.Out)
panel_4 = Panel(python_2.A)
