# Grasshopper definition Sphere101.gh (Grasshopper 1.0.7)

sphereradius = Slider(61, range=0..100)
mypoint = Point(<point referenced from the Rhino model>)
ghpython_script = GhPythonScript(x=mypoint, y=sphereradius)  # -> out, a
# ---------- ghpython_script: Python ----------
__author__ = "Sculpture"
__version__ = "2019.10.20"

import rhinoscriptsyntax as rs

myPoint = x 


myRadius = y

mySphere = rs.AddSphere(myPoint,myRadius)

a = mySphere
# ---------- end ghpython_script ----------
panel = Panel(ghpython_script.a)
