# Grasshopper definition Sphere103.gh (Grasshopper 1.0.7)

sphereradius = Slider(61, range=0..100)
mypoint = Point(<point referenced from the Rhino model>)
ghpython_script = GhPythonScript(x=mypoint, y=sphereradius)  # -> out, a
# ---------- ghpython_script: Python ----------
__author__ = "Sculpture"
__version__ = "2019.10.20"

import rhinoscriptsyntax as rs
i = 1
for i in range(1,10):
    myPoint = rs.GetPoint("Type in a point rubber nuts!")
    
    
    myRadius = rs.GetReal("Pretty good dupa, but I still need a number!")
    
    mySphere = rs.AddSphere(myPoint,myRadius)
    
    a = rs.AddSphere(myPoint, myRadius)
    i += 1
# ---------- end ghpython_script ----------
panel = Panel(ghpython_script.a)
