# Grasshopper definition Sphere104.gh (Grasshopper 1.0.7)

number_slider = Slider(0.31, range=0..1)
number_slider_2 = Slider(0.883, range=0..1)
multiplication = Multiplication(A=number_slider, B=Slider(2, range=0..10))
ghpython_script = GhPythonScript(radius=number_slider, spacing=multiplication, num=Slider(40, range=1..40))  # -> out, spheres; inputs num: Int32
# ---------- ghpython_script: Python ----------
__author__ = "Sculpture"
__version__ = "2019.10.20"

import rhinoscriptsyntax as rs

myAwesomeList = []

for i in range(0,num):
    myPoint = (spacing * i,0,0)
    
    myRadius = radius
    
    mySphere = rs.AddSphere(myPoint,myRadius)
    
    myAwesomeList.append(mySphere)

spheres = myAwesomeList
# ---------- end ghpython_script ----------
panel = Panel(ghpython_script.out)
