# Grasshopper definition Sphere106.gh (Grasshopper 1.0.7)

sin = Slider(0.98, range=0..1)
tan = Slider(0.925, range=0..1)
multiplication = Multiplication(A=tan, B=Slider(2.874, range=0..10))
ghpython_script = GhPythonScript(radius=tan, spacing=multiplication, num=Slider(20, range=1..40))  # -> out, spheres; inputs num: Int32
# ---------- ghpython_script: Python ----------
__author__ = "Sculpture"
__version__ = "2019.10.20"

import rhinoscriptsyntax as rs
import math
myAwesomeList = []


for i in range(0,num):
    for j in range(0,num):
        myPoint = (spacing * i,spacing * j,0)
        
        myRadius = math.tan(i*j)*radius
        
        mySphere = rs.AddSphere(myPoint,myRadius)
        print(myPoint)
        
        myAwesomeList.append(mySphere)

spheres = myAwesomeList
# ---------- end ghpython_script ----------
panel = Panel(ghpython_script.out)
