# Grasshopper definition TinkerCode101.gh (Grasshopper 1.0.7)

curve = Curve(<curve referenced from the Rhino model>)
ghpython_script = GhPythonScript(sLine=curve, levels=Slider(4, range=0..10), branches=Slider(4, range=1..10), rotDom=Slider(25, range=-25..25))  # -> out, Lines; inputs sLine: Curve, levels: Int32, branches: Int32
# ---------- ghpython_script: Python ----------
__author__ = "Sculpture"
__version__ = "2019.10.20"

import rhinoscriptsyntax as rs
import math
import random
import scriptcontext

bLines = []

def drawbranch(x,line):
    scriptcontext.escape_test()
    if x==0:
        return
    else:
        for i in range(0,branches):
            endpt = rs.CurveEndPoint(line)
            stpt= rs.CurveStartPoint(line)
            vect = rs.VectorCreate(endpt,stpt)
            rnd = random.randint(rotDom,rotDom)
            rndrot1 = random.randint(-5,5)
            rndrot2 = random.randint(-5,5)
            vect = rs.VectorRotate(vect,rnd,[rndrot1,rndrot2,0])
            ptadd = rs.PointAdd(endpt,vect)
            bLines.append(rs.AddLine(endpt,ptadd))
            drawbranch(x-1,bLines[-1])

drawbranch(levels,sLine)
Lines = bLines
# ---------- end ghpython_script ----------
curve_2 = Curve(ghpython_script.Lines)
horizontal_frame = HorizontalFrame(Curve=reparameterize(curve_2), Parameter=Slider(1, range=0..1))
perp_frames = PerpFrames(Curve=curve_2, Count=10, Align=True)  # -> Frames, Parameters
extrude = Extrude(Base=curve_2, Direction=expr("x*3", horizontal_frame))
extrude_2 = Extrude(Base=extrude, Direction=horizontal_frame)
