# Grasshopper definition TinkerCode102.gh (Grasshopper 1.0.7)

number_slider = Slider(1, range=1..9)
curve = Curve(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)
ghpython_script = GhPythonScript(sLine=curve, levels=Slider(4, range=0..10), branches=Slider(4, range=1..10), rotDom=Slider(25, range=-25..25))  # -> out, Lines; inputs sLine: Curve, levels: Int32, branches: Int32
# ---------- ghpython_script: Python ----------
__author__ = "Sculpture"
__version__ = "2019.10.20"

import rhinoscriptsyntax as rs
import math
import random
import scriptcontext

bLines = []

def drawbranch(x,line):
    scriptcontext.escape_test()
    if x==0:
        return
    else:
        for i in range(0,branches):
            endpt = rs.CurveEndPoint(line)
            stpt= rs.CurveStartPoint(line)
            vect = rs.VectorCreate(endpt,stpt)
            rnd = random.randint(rotDom,rotDom)
            rndrot1 = random.randint(-5,5)
            rndrot2 = random.randint(-5,5)
            vect = rs.VectorRotate(vect,rnd,[rndrot1,rndrot2,0])
            ptadd = rs.PointAdd(endpt,vect)
            bLines.append(rs.AddLine(endpt,ptadd))
            drawbranch(x-1,bLines[-1])

drawbranch(levels,sLine)
Lines = bLines
# ---------- end ghpython_script ----------
curve_2 = Curve(ghpython_script.Lines)
horizontal_frame = HorizontalFrame(Curve=reparameterize(curve_2), Parameter=Slider(1, range=0..1))
point_on_curve = PointOnCurve(curve_2, parameter=1)
point_on_curve_2 = PointOnCurve(curve_2, parameter=0)
point_on_curve_3 = PointOnCurve(curve_2, parameter=0.522)
pi = Pi(Factor=Slider(1.2, range=1.01..1.99))
rotate_3d = Rotate3D(Geometry=horizontal_frame, Angle=pi, Center=point_on_curve_3, Axis=Vector(0, 0, 1))  # -> Geometry, Transform
geometry = Geometry(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)
geometry_2 = Geometry(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)
box_2pt = Box2Pt(PointA=point_on_curve_2, PointB=point_on_curve, Plane=rotate_3d.Geometry)
box_morph = BoxMorph(Geometry=geometry, Reference=geometry_2, Target=box_2pt)
