# Grasshopper definition Wickerson.gh (Grasshopper 1.0.7)

number_slider = Slider(5, range=1..10)
number_slider_2 = Slider(10, range=0..10)
construct_point = ConstructPoint(XCoordinate=Slider(100, range=0..100), YCoordinate=Slider(100, range=0..100), ZCoordinate=Slider(0, range=0..10))
unit_z = UnitZ(Factor=number_slider_2)
rectangle = Rectangle(Plane=construct_point, XSize=number_slider_2, YSize=number_slider_2, Radius=0)  # -> Rectangle, Length
move = Move(Geometry=rectangle.Rectangle, Motion=unit_z)  # -> Geometry, Transform
area = Area(Geometry=move.Geometry)  # -> Area, Centroid
scale = Scale(Geometry=move.Geometry, Center=area.Centroid, Factor=expr("x/10", Slider(5, range=1..10)))  # -> Geometry, Transform
radians = Radians(Degrees=expr("-x*5", Slider(0, range=0..10)))
rotate = Rotate(Geometry=scale.Geometry, Angle=expr("x*10", radians), Plane=area.Centroid)  # -> Geometry, Transform
loft = Loft(
    Curves=[rotate.Geometry, rectangle.Rectangle],
    Options={Adjust=False, Closed=False, LoftEnds=0, LoftSimp=0, LoftType=0, Rebuild=10, Refit=0.01})
cap_holes = CapHoles(Brep=loft)
ghpython_script = GhPythonScript(x=cap_holes)  # -> out, a
# ---------- ghpython_script: Python ----------
__author__ = "mwickerson"
__version__ = "2019.10.15"

import rhinoscriptsyntax as rs
for input in ghenv.Component.Params.Input:
    for source in input.Sources:
        a = str(source.InstanceGuid)
# ---------- end ghpython_script ----------
panel = Panel(ghpython_script.a)
