# Grasshopper definition hoopsnake001.gh (Grasshopper 1.0.7)
# plug-ins: HoopSnake, Bifocals

hoopsnake = HoopSnake(
    StartingData=Slider(7, range=0..10),
    Data=evaluate,
    TerminationCondition=Slider(40, range=0..100),
    Hoopsnake_Data_autoUpdate=False,
    Hoopsnake_Data_dataLimit=2147483647,
    Hoopsnake_Data_resetCounter=True,
    Hoopsnake_Data_updateView=True)  # -> Feedback, FeedbackHistory, LoopsCounter, IterationsCounter
evaluate = Evaluate(Expression="x+x", x=hoopsnake.Feedback)
param_viewer = ParamViewer(hoopsnake.FeedbackHistory)
panel = Panel(hoopsnake.FeedbackHistory)
panel_2 = Panel(hoopsnake.Feedback)
panel_3 = Panel(hoopsnake.IterationsCounter)
panel_4 = Panel(hoopsnake.LoopsCounter)
