# Grasshopper definition unnameAdrianPlateMarch14th.gh (Grasshopper 1.0.7)

number_slider = Slider(28, range=0..100)
number_slider_2 = Slider(9, range=0..10)
polygon = Polygon(Plane=PlaneXY(0, 0, 0), Radius=number_slider, Segments=Slider(5, range=0..100), FilletRadius=0)  # -> Polygon, Length
series = Series(Start=Slider(0, range=0..100), Step=Slider(1.336, range=0..21), Count=number_slider_2)
circle = Circle(Plane=PlaneXY(0, 0, 0), Radius=number_slider)
curve = Curve(<curve referenced from the Rhino model>)
unit_z = UnitZ(Factor=series)
move = Move(Geometry=curve, Motion=unit_z)  # -> Geometry, Transform
area = Area(Geometry=move.Geometry)  # -> Area, Centroid
series_2 = Series(Start=Slider(0.01, range=0..0.01), Step=Slider(0.1, range=0..2), Count=number_slider_2)
scale = Scale(Geometry=move.Geometry, Center=area.Centroid, Factor=series_2)  # -> Geometry, Transform
series_3 = Series(Start=0, Step=Slider(10, range=0..10), Count=10)
rotate_3d = Rotate3D(Geometry=scale.Geometry, Angle=degrees(series_3), Center=area.Centroid, Axis=Vector(0, 0, 1))  # -> Geometry, Transform
loft = Loft(
    Curves=rotate_3d.Geometry,
    Options={Adjust=False, Closed=False, LoftEnds=0, LoftSimp=0, LoftType=0, Rebuild=10, Refit=0.01})
